# Grasshopper definition 2015 04 09 - Script Compilation in GH.gh (Grasshopper 1.0.7)
# plug-ins: HoopSnake

number_slider = Slider(0.5, range=0..1)

# ---- group: Head
point = Point(<point referenced from the Rhino model>)

# ----
node_type = ValueList({"Support": "1", "Load": "2", "Float": "3", "End": "4", "Corner": "5", "Tri": "6", "Quad": "7"}, selected="Support")
tail = Point(<point referenced from the Rhino model>)
make_node = MakeNode(tail=tail, head=point, type=node_type)

# ---- group: Head
point_2 = Point(<point referenced from the Rhino model>)

# ----
node_type_2 = ValueList({"Support": "1", "Load": "2", "Float": "3", "End": "4", "Corner": "5", "Tri": "6", "Quad": "7"}, selected="Load")
tail_2 = Point(<point referenced from the Rhino model>)
make_node_2 = MakeNode(tail=tail_2, head=point_2, type=node_type_2)

# ---- group: Head
point_3 = Point(<point referenced from the Rhino model>)

# ----
node_type_3 = ValueList({"Support": "1", "Load": "2", "Float": "3", "End": "4", "Corner": "5", "Tri": "6", "Quad": "7"}, selected="Load")
tail_3 = Point(<point referenced from the Rhino model>)
make_node_3 = MakeNode(tail=tail_3, head=point_3, type=node_type_3)

# ---- group: Head
point_4 = Point(<point referenced from the Rhino model>)

# ----
node_type_4 = ValueList({"Support": "1", "Load": "2", "Float": "3", "End": "4", "Corner": "5", "Tri": "6", "Quad": "7"}, selected="Support")
tail_4 = Point(<point referenced from the Rhino model>)
make_node_4 = MakeNode(tail=tail_4, head=point_4, type=node_type_4)

xy = XYPlane(Origin=Point(0, 0, 0))
X = UnitX(Factor=1)
multiplication = Multiplication(A=Slider(10, range=0..10), B=Slider(2, range=0..100))

# ----
# BOUNDARY
curve = Curve(<curve referenced from the Rhino model>)

line = LineSDL(Start=xy, Direction=X, Length=1)
rad = Radians(Degrees=multiplication)
deg = Degrees(Radians=multiplication)
rotate = Rotate(Geometry=line, Angle=rad, Plane=xy)  # -> Geometry, Transform

data = Data([make_node_4, make_node])

data_2 = Data(curve)

data_3 = Data([make_node_2, make_node_3])

# ---- group: Make Assembly
makeassembly = MakeAssembly(loads=data_3, supports=data, boundary=data_2)

# ----
panel = Panel(makeassembly)
python_script = PythonScript(StartShape=makeassembly)  # -> simplify(nodenames), pts, history, b, c, projection; disabled
# ---------- python_script: Python ----------
import rhinoscriptsyntax as rs
import ghpythonlib.components as gh
import Rhino.Geometry as rg
import System.Drawing as sd
import math
import random

import Assembly as assembly
import Grammar as gr
import Rhino as rc
import Rules as rules
import GraphicStatics as gs

reload (assembly)
reload (gs)
reload (rules)
reload (gr)



node = StartShape.Nodes[2]
b = gh.Circle(node.Coordinate, 2.5)



"""
node2 = gs.FindClosestNodes(node, StartShape, 3)
print node2


d = gs.FindClosestProjections(node, StartShape, 1)
projection = d[1]
print d
"""
# ---------- end python_script ----------
python_script_2 = PythonScript(StartShape=makeassembly)  # -> a, history, bestDesigns
# ---------- python_script_2: Python ----------
import rhinoscriptsyntax as rs
import ghpythonlib.components as gh
import Grasshopper as Grasshopper
import Rhino.Geometry as rg
import System.Drawing as sd
import math
import random

import Assembly as assembly
import Grammar as gr
import Rhino as rc
import Rules as rules
import GraphicStatics as gs

reload (assembly)
reload (gs)
reload (rules)
reload (gr)


g = gr.Grammar()
b = gr.RandomComputation(g)
a = b.GenerateRandomAssembly(StartShape)

NUM = 4
bestNum = 5
bestDesigns = []



"""
for i in range(NUM):

    history = []

    
    a = b.GenerateRandomAssembly(StartShape)
    print a
    bestDesigns.append(a)
    
    
    for obj in ghenv.Component.OnPingDocument().Objects:
        if obj.NickName == "MakeAssembly":
            obj.ExpireSolution(False)
    
    
    for t in a.History.Rules:
        c = t[2].Name, "applied at Node", t[0]
        history.append(c)
    
    if len(bestDesigns) < bestNum:
        bestDesigns.append(a)
    else:
        bestDesigns.append(a)
        sorted(bestDesigns, key=lambda a: a.Score, reverse=False)
        bestDesigns.remove(bestDesigns[-1])
        """
# ---------- end python_script_2 ----------
python_script_3 = PythonScript(StartShape=makeassembly)  # -> simplify(nodenames), pts, history, b, c; disabled
# ---------- python_script_3: Python ----------
import rhinoscriptsyntax as rs
import ghpythonlib.components as gh
import Rhino.Geometry as rg
import System.Drawing as sd
import math
import random

import Assembly as assembly
import Grammar as gr
import Rhino as rc
import Rules as rules
import GraphicStatics as gs

reload (assembly)
reload (gs)
reload (rules)
reload (gr)


nodenames = StartShape.Nodes
pts =[]
for node in nodenames:
    pts.append(node.Coordinate)
print nodenames


node = StartShape.Nodes[0]
b = gh.Circle(node.Coordinate, 2.5)
print gs.GetNodeIndex(node, StartShape)
print node




a = gs.FindClosestNode(node, StartShape)
c = gh.Circle(a[0].Coordinate, 5)

print a[1]

print nodenames
# ---------- end python_script_3 ----------
python_script_4 = PythonScript(x=makeassembly)  # -> a; disabled
# ---------- python_script_4: Python ----------
a = []
for t in x.History.Rules:
    b = t[2].Name, 'applied at Node', t[0]
    a.append(b)
# ---------- end python_script_4 ----------
point_5 = Point(python_script.projection)  # disabled
python_script_5 = PythonScript(StartShape=makeassembly)  # -> a
# ---------- python_script_5: Python ----------
import rhinoscriptsyntax as rs
import ghpythonlib.components as gh
import Rhino.Geometry as rg
import System.Drawing as sd
import math
import random

import Assembly as assembly
import Grammar as gr
import Rhino as rc
import Rules as rules
import GraphicStatics as gs
import GoCode as gc

reload (assembly)
reload (gs)
reload (rules)
reload (gr)
reload (gc)

a = gc.Generate(StartShape)
# ---------- end python_script_5 ----------
boolean_toggle = BooleanToggle(False)  # disabled
panel_2 = Panel("5")  # disabled
panel_3 = Panel(python_script_5)
boolean_toggle_2 = BooleanToggle(False)
dispatch = Dispatch(List=True, DispatchPattern=boolean_toggle_2)  # -> ListA, ListB
python_script_6 = PythonScript()  # -> out, a; disabled
# ---------- python_script_6: Python ----------
import rhinoscriptsyntax as rs
import ghpythonlib.components as gh
import Grasshopper as Grasshopper
import Rhino.Geometry as rg
import System.Drawing as sd
import math
import random


"""
for obj in ghenv.Component.OnPingDocument().Objects:
    if obj.NickName == "MakeAssembly":
        obj.ExpireSolution(False)


for obj in ghenv.Component.OnPingDocument().Objects:
    if obj.NickName == "MakeAssembly":
        obj.NewSolution(False)

"""
"""

Grasshopper.Instances.ActiveCanvas.Document.ExpireSolution()
#Grasshopper.Instances.ActiveCanvas.Document.NewSolution(False)
"""

for obj in ghenv.Component.OnPingDocument().Objects:
    if obj.NickName == "MakeAssembly":
        obj.ExpireSolution(False)
# ---------- end python_script_6 ----------
display_assembly_components = DisplayAssemblyComponents(
    data=makeassembly,
    dispatch_pattern=Toggle(True),
    dispatch_pattern_2=Toggle(False),
    dispatch_pattern_4=Toggle(True),
    dispatch_pattern_5=Toggle(True),
    dispatch_pattern_3=Toggle(True),
    dispatch_pattern_6=Toggle(True),
    dispatch_pattern_7=Toggle(True),
    dispatch_pattern_8=boolean_toggle_2,
    dispatch_pattern_9=boolean_toggle_2)
python_script_7 = PythonScript(StartShape=python_script_8.a)  # -> StartShape; disabled; unedited script template
hoopsnake = HoopSnake(
    Data=python_script_7,
    TerminationCondition=smaller_than.OrEqualTo,
    Trigger=boolean_toggle,
    Hoopsnake_Data_autoUpdate=False,
    Hoopsnake_Data_dataLimit=2147483647,
    Hoopsnake_Data_delay=0,
    Hoopsnake_Data_resetCounter=True,
    Hoopsnake_Data_updateView=True)  # -> Feedback, flatten(CumulativeFeedback), LoopsCounter, IterationsCounter; disabled
smaller_than = SmallerThan(FirstNumber=hoopsnake.IterationsCounter, SecondNumber=panel_2)  # -> SmallerThan, OrEqualTo; disabled
python_script_8 = PythonScript(StartShape=hoopsnake.Feedback)  # -> a, StartShape; disabled
# ---------- python_script_8: Python ----------
import rhinoscriptsyntax as rs
import ghpythonlib.components as gh
import Grasshopper as Grasshopper
import Rhino.Geometry as rg
import System.Drawing as sd
import math
import random

import Assembly as assembly
import Grammar as gr
import Rhino as rc
import Rules as rules
import GraphicStatics as gs

reload (assembly)
reload (gs)
reload (rules)
reload (gr)


g = gr.Grammar()
b = gr.RandomComputation(g)



a = b.GenerateRandomAssembly(StartShape)


for obj in ghenv.Component.OnPingDocument().Objects:
    if obj.NickName == "MakeAssembly":
        obj.ExpireSolution(False)
        



Grasshopper.Instances.ActiveCanvas.Document.NewSolution(False)














#Grasshopper.Instances.ActiveCanvas.Document.NewSolution(False)

"""
for obj in ghenv.Component.OnPingDocument().Objects:
    if obj.NickName == "MakeAssembly":
        obj.ExpireSolution(False)
"""
# ---------- end python_script_8 ----------
panel_4 = Panel(python_script_8.StartShape)  # disabled
panel_5 = Panel(python_script_8.a)  # disabled
panel_6 = Panel(hoopsnake.CumulativeFeedback)  # disabled

# ==== cluster MakeNode
tail = ClusterInput()
head = ClusterInput()
type = ClusterInput()
# SUPPORTS INPUT
tail_2 = Point(tail)
head_2 = Point(head)
support_points_input = PythonScript(Tail=tail_2, Head=head_2, Type=type)  # -> AppliedForce, Color, Node; inputs Tail: Point3d, Head: Point3d
# ---------- support_points_input: Python ----------
import rhinoscriptsyntax as rs
import ghpythonlib.components as gh
import Rhino.Geometry as rg
import Rhino as rc
import System.Drawing as sd

import Assembly as assembly
import Grammar as gr
import Rules as r
import GraphicStatics as gs

reload (assembly)
reload (gs)

################################################################################

AppliedForce = gh.Line(Tail, Head) #GH Line Object

################################################################################
# IDENTIFY & ASSIGN

"""
Pass = 0
Support = 1
Load = 2
Float = 3
End = 4
Corner = 5
Tri = 6
Quad = 7
"""

if Type == "1": #Support Point
    ThisNodeType = assembly.NodeType.Support
    ThisForceType = assembly.ForceType.Reaction
    Color = "252, 223,33" #yellow, for support reactions

if Type == "2": #Load Point
    ThisNodeType = assembly.NodeType.Load
    ThisForceType = assembly.ForceType.Applied
    Color = "0, 113, 189" #blue, for applied loads

################################################################################
# CONSTRUCT ASSEMBLY.FORCE

ForceList=[]
Force = assembly.Force(AppliedForce, ThisForceType, -1)
ForceList.append(Force)


Node = assembly.Node(Head, ThisNodeType, ForceList)

Node = gs.RearrangeForces(Node)
Node = gs.EquilibrateNode(Node)
print Node.Forces
################################################################################

"""
print Node.Coordinate
print ThisNodeType
print "Force Head = ", Head
print "Force Tail = ", Tail
print Color 
"""
# ---------- end support_points_input ----------
colour_swatch = ColourSwatch(SwatchColor=RGB(252, 223, 33))

force_display = ForceDisplay(
    line=graft(support_points_input.AppliedForce),
    force_type="1",
    tension_compresion="-1",
    colour=support_points_input.Color)

vector_display_ex = VectorDisplayEx(Point=tail_2, Vector=support_points_input.AppliedForce, Colour=support_points_input.Color, Width="2")  # disabled
node = ClusterOutput(support_points_input.Node)

# ==== cluster MakeAssembly
loads = ClusterInput()
supports = ClusterInput()
boundary = ClusterInput()
loads_2 = Data(loads)
supports_2 = Data(supports)
boundary_2 = Data(boundary)
python_script = PythonScript(Loads=loads_2, Supports=supports_2, Boundary=boundary_2)  # -> StartShape; inputs Loads: list, Supports: list, Boundary: Curve
# ---------- python_script: Python ----------
import rhinoscriptsyntax as rs
import ghpythonlib.components as ghcomp
import Rhino.Geometry as rg
import Rhino as rc
import Rules as r
import System.Drawing as sd


################################################################################
#  IMPORT JUNEY FILES

import Assembly as assembly
import Grammar as gr


################################################################################
#  COMPILE NODES

NodeList = []
NodeList.extend(Loads)
NodeList.extend(Supports)


################################################################################
#  CREATE ASSEMBLY INSTANCE

StartShape = assembly.Assembly(NodeList, [], Boundary)

print StartShape.MyState
print len(StartShape.Nodes)
# ---------- end python_script ----------
startshape = ClusterOutput(python_script)

# ==== cluster DisplayAssemblyComponents
dispatch_pattern = ClusterInput()
dispatch_pattern_2 = ClusterInput()
dispatch_pattern_3 = ClusterInput()
dispatch_pattern_4 = ClusterInput()
dispatch_pattern_5 = ClusterInput()
data = ClusterInput()
dispatch_pattern_6 = ClusterInput()

# ---- group: Assembly
data_2 = Data(data)

# ----
dispatch_pattern_7 = ClusterInput()
dispatch_pattern_8 = ClusterInput()
dispatch_pattern_9 = ClusterInput()
dispatch = Dispatch(List=data_2, DispatchPattern=dispatch_pattern)  # -> ListA, ListB
dispatch_2 = Dispatch(List=data_2, DispatchPattern=dispatch_pattern_5)  # -> ListA, ListB
dispatch_3 = Dispatch(List=data_2, DispatchPattern=dispatch_pattern_6)  # -> ListA, ListB
dispatch_4 = Dispatch(List=data_2, DispatchPattern=dispatch_pattern_7)  # -> ListA, ListB
number_slider = Slider(0.4, range=0..1)

# ---- group: DISPLAY TEMP FORCES
# DISPLAY TEMP FORCES
python_script = PythonScript(Assembly=dispatch.ListA)  # -> a, NodeTempForces, TempForceLines
# ---------- python_script: Python ----------
import rhinoscriptsyntax as rs
import ghpythonlib.components as gh
import Rhino.Geometry as rg
import System.Drawing as sd
import math
import random

import Assembly as assembly
import Grammar as gr
import Rhino as rc
import Rules as r
import GraphicStatics as gs

reload (assembly)
reload (gs)
reload (r)


nodes = []
for node in Assembly.Nodes:
    nodes.append(node.Coordinate)


TempForceLines = []
for node in Assembly.Nodes: # for every node
    for i in range(0,len(node.Forces)): #for every force at node
        if node.Forces[i].Type == 3: #if the force is a temporary force
            TempForceLines.append(node.Forces[i].Line)

print TempForceLines
# ---------- end python_script ----------

# ----
# DISPLAY FORCE POLYGONS
python_script_2 = PythonScript(Assembly=dispatch_3.ListA, startyoffset=Slider(-17, range=-20..-5))  # -> out, gridofpts, polygons, colors, ReactionForceLines, AppliedForceLines, TempForceLines, MemberForceLines, CompressionMembers, TensionMembers
# ---------- python_script_2: Python ----------
import rhinoscriptsyntax as rs
import ghpythonlib.components as gh
import Rhino.Geometry as rg
import System.Drawing as sd
import math
import random

import Assembly as assembly
import Grammar as gr
import Rhino as rc
import Rules as rules
import GraphicStatics as gs

reload (assembly)
reload (gs)
reload (rules)
reload (gr)


#boundary points
nodecount = len(Assembly.Nodes)
boundary = Assembly.Boundary
boundarypts = gh.DeconstructBrep(boundary)[2]


################################################################################
x = []
y = []
for pt in boundarypts:
    x.append(pt.X)
    y.append(pt.Y)

x = gh.SortList(x)[0]
y = gh.SortList(y)[0]

xrange = x[-1]-x[0]
xmid = xrange/2
startx = x[0]
starty = startyoffset

xcount = 5
xspacing = xrange/xcount
ycount = int(math.ceil(nodecount/xcount))
yspacing = -10

################################################################################
gridofpts = []

firstrowpts = []
for i in range(0,xcount+1):
    pt = rg.Point3d(xspacing*i, starty, 0)
    firstrowpts.append(pt)
gridofpts.append(firstrowpts)

if ycount > 1:
    for i in range(0,ycount-1):
        translation = gh.Vector2Pt(rg.Point3d(0,0,0), rg.Point3d(0,yspacing,0))[0]
        nextrow = gh.Move(gridofpts[-1], translation)[0]
        gridofpts.append(nextrow)
else:
    pass
gridofpts  = [val for sublist in gridofpts for val in sublist]


del gridofpts[nodecount:]



################################################################################
#Force Polygon
polygons = []
for i in range(0,len(Assembly.Nodes)):
    d = gs.DrawNodeForcePolygon(Assembly.Nodes[i], rg.Point3d(gridofpts[i]))
    polygons.append(d)


ReactionForceLines = []
for forcelist in polygons: # for every node
    for force in forcelist: #for every force at node
        if force.Type == 1: #if the force is a temporary force
            ReactionForceLines.append(force.Line)

AppliedForceLines = []
for forcelist in polygons: # for every node
    for force in forcelist: #for every force at node
        if force.Type == 2: #if the force is a temporary force
            AppliedForceLines.append(force.Line)

TempForceLines = []
for forcelist in polygons: # for every node
    for force in forcelist: #for every force at node
        if force.Type == 3: #if the force is a temporary force
            TempForceLines.append(force.Line)

MemberForceLines = []
for forcelist in polygons: # for every node
    for force in forcelist: #for every force at node
        if force.Type == 4: #if the force is a temporary force
            MemberForceLines.append(force.Line)

CompressionMembers =[]
TensionMembers = []
for forcelist in polygons: # for every node
    for force in forcelist: #for every force at node
        if force.Type == 4: #if the force is a temporary force
            if force.Direction == -1:
                CompressionMembers.append(force.Line)
            else:
                TensionMembers.append(force.Line)



################################################################################



colors = ["219, 107,4", "225, 212,0", "140, 198, 63", "58, 178, 221", "0, 105, 151", "216, 75, 141", "146, 10, 120"]
"""
Orange = "219, 107,4"
Yellow = "225, 212,0"
Green = "140, 198, 63"
Sky = "58, 178, 221"
Blue = "0, 105, 151"
Magenta = "216, 75, 141"
Purple = "146, 10, 120"
"""
# ---------- end python_script_2 ----------
python_script_3 = PythonScript(x=python_script_2.polygons)  # -> a, list; inputs x: list
# ---------- python_script_3: Python ----------
import collections
from Grasshopper import DataTree
from Grasshopper.Kernel.Data import GH_Path


def unpackList(nestedlist):
    dataTree = DataTree[object]()
    for i, item_list in enumerate(nestedlist):
        path = GH_Path(i)
        dataTree.AddRange(item_list, path)
    return dataTree

a = unpackList(x) 













"""
def unpackList(lst):
    tree = DataTree[object]()
    
    for elem in lst:
        path=GH_Path(0)
        if isinstance(elem, collections.Iterable):
            tree.MergeTree(unpackList(elem,path.AppendElement(0)))
        else:
            print(path)
            #tree.Add(elem)
            #tree.Add(elem,path)
            tree.Add(elem,path)
        path = path.Increment(-1)
    return tree

a = unpackList(x) 


list = []
for i in range(0,len(x)):
    a = unpackList(x[i]) 
    list.append(a)
"""
# ---------- end python_script_3 ----------

python_script_4 = PythonScript(Assembly=dispatch_4.ListA)  # -> pt, ptlist, history, indexlist, colorlist, historywithindex
# ---------- python_script_4: Python ----------
import rhinoscriptsyntax as rs
import ghpythonlib.components as gh
import Rhino.Geometry as rg
import System.Drawing as sd
import math
import random

import Assembly as assembly
import Grammar as gr
import Rhino as rc
import Rules as rules
import GraphicStatics as gs

reload (assembly)
reload (gs)
reload (rules)
reload (gr)


#boundary points
nodecount = len(Assembly.Nodes)
boundary = Assembly.Boundary
boundarypts = gh.DeconstructBrep(boundary)[2]

colors = [
"219, 107,4",
"225, 212,0",
"140, 198, 63",
"58, 178, 221",
"0, 105, 151",
"216, 75, 141",
"146, 10, 120"]

"""
0. Orange = "219, 107,4"

1. Yellow = "225, 212,0"
2. Green = "140, 198, 63"
3. Sky = "58, 178, 221"
4. Blue = "0, 105, 151"
5. Magenta = "216, 75, 141"

6. Purple = "146, 10, 120"
"""

################################################################################
x = []
y = []
for pt in boundarypts:
    x.append(pt.X)
    y.append(pt.Y)

x = gh.SortList(x)[0]
y = gh.SortList(y)[0]

pt = rg.Point3d(x[-1]+10, y[-1], 0)
pt1 = rg.Point3d(x[-1]+10, y[-1]-3, 0)

################################################################################

history = []
for t in Assembly.History.Rules:
    b = t[2].Name, 'applied at Node', t[0]
    history.append(b)

print history[-1]
################################################################################

ptlist = []
ptlist.append(pt1)

vector = gh.UnitY(-1.5)
for i in range(0,len(history)-1):
    mpt = gh.Move(ptlist[-1], vector)[0]
    ptlist.append(mpt)

################################################################################

colorlist = []
for i in range(0,len(history)):
    if history[i][0] == "Rule 0: 'START'":
        colorlist.append(colors[0]) #0. Orange = 219, 107,4

    elif history[i][0] == "Rule 1: 'Create Node'":
        colorlist.append(colors[1]) #1. Yellow = 225, 212,0

    elif history[i][0] == "Rule 2: 'Extend Node'":
        colorlist.append(colors[2]) #2. Green = 140, 198, 63

    elif history[i][0] == "Rule 3: 'Split Node'":
        colorlist.append(colors[3]) #3. Sky = 58, 178, 221

    elif history[i][0] == "Rule 4: 'Connect with Element'":
        colorlist.append(colors[4]) #4. Blue = 0, 105, 151

    elif history[i][0] == "Rule 5: 'Connect via Projection'":
        colorlist.append(colors[5]) #5. Magenta = 216, 75, 141

    if history[i][0] == "Rule 7: 'System Close'" or history[i][0] == "Rule 8: 'END'":
        colorlist.append(colors[6]) #6. Purple = 146, 10, 120



################################################################################

indexlist = []
historywithindex = []
for i in range(0,len(history)):
    indexlist.append((i+1,'.'))
    c = (indexlist[i], history[i])
    historywithindex.append(c)
# ---------- end python_script_4 ----------
unit_x = UnitX(Factor=number_slider)

# ---- group: Display Temp Forces
cluster = Cluster(line=python_script.TempForceLines)

# ----
replace_text = ReplaceText(Text=flatten(python_script_4.historywithindex), Find="(", RecursiveReplace=False)
unit_y = UnitY(Factor=number_slider)
text_tag_3d = TextTag3D(
    Location=python_script_4.pt,
    Text="RULE HISTORY",
    Size=1.5,
    Colour=ColourSwatch(SwatchColor=RGB(102, 102, 102)),
    Justification=1)
unit_y_2 = UnitY(Factor=Slider(1.03, range=0..2))
unit_y_3 = UnitY(Factor=Slider(0.4, range=0..1))

# ---- group: FORM DIAGRAM - VISUAL SCALE
number_slider_2 = Slider(1.5, range=0.1..5)

# ---- group: LINEWEIGHT
number_slider_3 = Slider(1, range=1..10)

# ----
# DISPLAY SUPPORTS
python_script_5 = PythonScript(Assembly=dispatch_2.ListA)  # -> a
# ---------- python_script_5: Python ----------
import rhinoscriptsyntax as rs
import ghpythonlib.components as gh
import Rhino.Geometry as rg
import System.Drawing as sd
import math
import random

import Assembly as assembly
import Grammar as gr
import Rhino as rc
import Rules as r
import GraphicStatics as gs

reload (assembly)
reload (gs)
reload (r)

a=[]
for i in range(0,len(Assembly.Nodes)):
    if Assembly.Nodes[i].Type == 1:
        a.append(Assembly.Nodes[i].Coordinate)
# ---------- end python_script_5 ----------
pin_support = PINSUPPORT(
    support_location=graft(python_script_5),
    color=ColourSwatch(SwatchColor=RGB(0, 0, 0)),
    lineweight_scale=number_slider_3,
    visual_scale=number_slider_2)

replace_text_2 = ReplaceText(Text=flatten(replace_text), Find=")", RecursiveReplace=False)
replace_text_3 = ReplaceText(Text=flatten(replace_text_2), Find="'", RecursiveReplace=False)
colour_swatch = ColourSwatch(SwatchColor=RGB(0, 0, 0))

# ----
# LABEL FORCE POLYGON NODES
# DISPLAY RULE HISTORY
number_slider_4 = Slider(-5, range=-5..0)
unit_x_2 = UnitX(Factor=number_slider_4)
move = Move(Geometry=python_script_2.gridofpts, Motion=unit_x_2)  # -> Geometry, Transform
unit_y_4 = UnitY(Factor=number_slider_4)
move_2 = Move(Geometry=python_script_2.gridofpts, Motion=unit_y_4)  # -> Geometry, Transform
item_index = ItemIndex(List=move_2.Geometry, Item=move_2.Geometry)
text_tag_3d_2 = TextTag3D(
    Location=move_2.Geometry,
    Text=item_index,
    Size=Slider(1, range=1..5),
    Colour=ColourSwatch(SwatchColor=RGB(191, 191, 191)),
    Justification=7)

force_display = ForceDisplay_3(
    line=graft(python_script_2.AppliedForceLines),
    force_type="1",
    tension_compresion="-1",
    colour=ColourSwatch(SwatchColor=RGB(0, 113, 189)))

force_display_2 = ForceDisplay_3(
    line=graft(python_script_2.TempForceLines),
    force_type="1",
    tension_compresion="-1",
    colour=ColourSwatch(SwatchColor=RGB(200, 6, 38)))

replace_text_4 = ReplaceText(Text=flatten(replace_text_3), Find=",", RecursiveReplace=False)

force_display_3 = ForceDisplay_3(
    line=graft(python_script_2.ReactionForceLines),
    force_type="1",
    tension_compresion="-1",
    colour=ColourSwatch(SwatchColor=RGB(252, 223, 33)))

colour_swatch_2 = ColourSwatch(SwatchColor=RGB(18, 97, 110))
colour_swatch_3 = ColourSwatch(SwatchColor=RGB(119, 0, 138))
colour_swatch_4 = ColourSwatch(SwatchColor=RGB(66, 66, 66))

# ---- group: Compression
force_display_4 = ForceDisplay_3(
    line=graft(python_script_2.CompressionMembers),
    force_type="1",
    tension_compresion="-1",
    colour=ColourSwatch(SwatchColor=RGB(33, 33, 33)))

# ---- group: Tension
force_display_5 = ForceDisplay_3(
    line=graft(python_script_2.TensionMembers),
    force_type="1",
    tension_compresion="1",
    colour=ColourSwatch(SwatchColor=RGB(143, 143, 143)))

# ----
text_tag_3d_3 = TextTag3D(Location=python_script_4.ptlist, Text=replace_text_4, Size=0.75, Colour=python_script_4.colorlist, Justification=1)

# ---- group: Display Reaction Forces
cluster_2 = Cluster_2()

# ----
# DISPLAY MEMBERS
python_script_6 = PythonScript(Assembly=data_2)  # -> nodes, members, memberforceamplitude, memberforcetype, thickness
# ---------- python_script_6: Python ----------
import rhinoscriptsyntax as rs
import ghpythonlib.components as gh
import Rhino.Geometry as rg
import System.Drawing as sd
import math
import random

import Assembly as assembly
import Grammar as gr
import Rhino as rc
import Rules as r
import GraphicStatics as gs

reload (assembly)
reload (gs)
reload (r)



members=[]


memberforceamplitude = []
memberforcetype = []


for member in Assembly.Members:
    members.append(member)
    memberforceamplitude.append(gs.GetMemberForce(member, Assembly)[0])
    memberforcetype.append(gs.GetMemberForce(member, Assembly)[1])

thickness = []
for type in memberforcetype:
    if type == -1:
        thickness.append(5)
    else:
        thickness.append(1)
# ---------- end python_script_6 ----------
colour_swatch_5 = ColourSwatch(SwatchColor=RGB(0, 0, 0))

dispatch_5 = Dispatch(List=python_script_6.members, DispatchPattern=dispatch_pattern_3)  # -> ListA, ListB

# ----
# DISPLAY MEMBER INDEX
offset = Offset(Curve=python_script_6.members, Distance=0.4, Plane=PlaneXY(0, 0, 0), Corners=1)
divide_curve = DivideCurve(Curve=offset, Count=2, Kinks=False)  # -> Points, Tangents, Parameters
colour_swatch_6 = ColourSwatch(SwatchColor=RGB(0, 0, 0))
list_item = ListItem(List=divide_curve.Points, Index=1, Wrap=True)  # -> simplify(flatten(Item))
item_index_2 = ItemIndex(List=dispatch_5.ListA, Item=dispatch_5.ListA)
text_tag_3d_4 = TextTag3D(Location=list_item, Text=item_index_2, Size=0.4, Colour=colour_swatch_6, Justification=5)

# ---- group: Force Amplitude
number = Number(simplify(python_script_6.memberforceamplitude))

# ---- group: Force Type
integer = Integer(python_script_6.memberforcetype)

# ----
line = Line(simplify(python_script_6.members))
dispatch_6 = Dispatch(List=line, DispatchPattern=dispatch_pattern_8)  # -> ListA, ListB
line_2 = Line(simplify(dispatch_6.ListA))
division = Division(A=number, B=Slider(20, range=1..20))
multiplication = Multiplication(A=division, B=-1)
offset_2 = Offset(Curve=line_2, Distance=division, Plane=PlaneXY(0, 0, 0), Corners=1)
offset_3 = Offset(Curve=line_2, Distance=multiplication, Plane=PlaneXY(0, 0, 0), Corners=1)
loft = Loft(
    Curves=[offset_2, offset_3],
    Options={Adjust=False, Closed=False, LoftEnds=0, LoftSimp=0, LoftType=0, Rebuild=10, Refit=0.01})  # -> simplify(Loft)
multiplication_2 = Multiplication(A=number, B=integer)  # -> flatten(Result)
brep_edges = BrepEdges(Brep=loft)  # -> simplify(Naked), Interior, NonManifold
panel = Panel(multiplication_2)
join_curves = JoinCurves(Curves=brep_edges.Naked, Preserve=False)
larger = LargerThan(FirstNumber=panel, SecondNumber="0")  # -> LargerThan, OrEqualTo
dispatch_7 = Dispatch(List=panel, DispatchPattern=larger.LargerThan)  # -> ListA, ListB
dispatch_8 = Dispatch(List=flatten(loft), DispatchPattern=larger.LargerThan)  # -> ListA, ListB
dispatch_9 = Dispatch(List=flatten(loft), DispatchPattern=larger.LargerThan)  # -> ListA, ListB

# ---- group: Force Amplitude
number_2 = Number(simplify(python_script_6.memberforceamplitude))

# ---- group: Force Type
integer_2 = Integer(python_script_6.memberforcetype)

# ----
line_3 = Line(simplify(python_script_6.members))
dispatch_10 = Dispatch(List=line_3, DispatchPattern=dispatch_pattern_9)  # -> ListA, ListB
line_4 = Line(simplify(dispatch_10.ListA))
division_2 = Division(A=number_2, B=Slider(20, range=1..20))
multiplication_3 = Multiplication(A=division_2, B=-1)
offset_4 = Offset(Curve=line_4, Distance=division_2, Plane=PlaneXY(0, 0, 0), Corners=1)
offset_5 = Offset(Curve=line_4, Distance=multiplication_3, Plane=PlaneXY(0, 0, 0), Corners=1)
loft_2 = Loft(
    Curves=[offset_4, offset_5],
    Options={Adjust=False, Closed=False, LoftEnds=0, LoftSimp=0, LoftType=0, Rebuild=10, Refit=0.01})  # -> simplify(Loft)
multiplication_4 = Multiplication(A=number_2, B=integer_2)  # -> flatten(Result)
brep_edges_2 = BrepEdges(Brep=loft_2)  # -> simplify(Naked), Interior, NonManifold
panel_2 = Panel(multiplication_4)
join_curves_2 = JoinCurves(Curves=brep_edges_2.Naked, Preserve=False)
larger_2 = LargerThan(FirstNumber=panel_2, SecondNumber="0")  # -> LargerThan, OrEqualTo
dispatch_11 = Dispatch(List=panel_2, DispatchPattern=larger_2.LargerThan)  # -> ListA, ListB
dispatch_12 = Dispatch(List=flatten(loft_2), DispatchPattern=larger_2.LargerThan)  # -> ListA, ListB
dispatch_13 = Dispatch(List=flatten(loft_2), DispatchPattern=larger_2.LargerThan)  # -> ListA, ListB
colour_swatch_7 = ColourSwatch(SwatchColor=RGBA(255, 0, 0, 75))
colour_swatch_8 = ColourSwatch(SwatchColor=RGBA(0, 0, 255, 50))
custom_preview = CustomPreview(
    Geometry=[dispatch_12.ListA, dispatch_13.ListA, dispatch_12.ListB, dispatch_13.ListB],
    Shader=ColourSwatch(SwatchColor=RGB(0, 0, 0)))

# ---- group: Node Hatch
number_slider_5 = Slider(0.15, range=0..1)
end_points = EndPoints(Curve=python_script_6.members)  # -> Start, End
circle = Circle(Plane=end_points.Start, Radius=number_slider_5)
circle_2 = Circle(Plane=end_points.End, Radius=number_slider_5)
createhatch = CreateHatch(Bake=False, Curves=[circle, circle_2], HatchPatternName="Solid", HatchScale=1, HatchRotation=0)
custom_preview_2 = CustomPreview(Geometry=createhatch, Shader=ColourSwatch(SwatchColor=RGB(0, 0, 0)))

# ----
length = Length(Curve=python_script_6.members)
multiplication_5 = Multiplication(A=flatten(length), B=flatten(python_script_6.memberforceamplitude))

# ----
# FL
panel_3 = Panel("Round(number, decimals)")
mass_addition = MassAddition(Input=multiplication_5)  # -> Result, PartialResults
point = Point(<point referenced from the Rhino model>)
evaluate = Evaluate(Expression=panel_3, number=mass_addition.Result, decimals=Slider(2, range=0..10))
concatenate = Concatenate(FragmentA="ΣFL = ", FragmentB=evaluate)
text_tag_3d_5 = TextTag3D(Location=point, Text=concatenate, Size=1.5, Colour=colour_swatch_6, Justification=4)

panel_4 = Panel(evaluate)

custom_preview_lineweights = CustomPreviewLineweights(Geometry=[circle, circle_2], Shader=colour_swatch_5, Thickness=expr("6", 1))  # disabled
custom_preview_lineweights_2 = CustomPreviewLineweights(Geometry=dispatch_5.ListA, Shader=colour_swatch_5, Thickness=python_script_6.thickness)

python_script_7 = PythonScript(x=evaluate, currentshape=data_2)  # -> out, a
# ---------- python_script_7: Python ----------
currentshape.Score = x
# ---------- end python_script_7 ----------

bnd = Bounds(Numbers=dispatch_7.ListB)
dedomain = DeconstructDomain(Domain=bnd)  # -> Start, End
gradient = Gradient(LowerLimit=dedomain.Start, UpperLimit="0", Parameter=dispatch_7.ListB, stops=[0: RGB(0, 0, 255), 1: RGB(0, 0, 255)])
simplebake = CSharpScript(obj=[dispatch_8.ListB, dispatch_9.ListB], layer="Compression", color=gradient)  # -> out; inputs obj: GeometryBase, name: String, layer: String, color: Color, activate: Boolean
# ---------- simplebake: C# ----------
    //Inserts geometry into the Rhino document, with custom attributes
    //Written by Giulio Piacentino - rewritten by [uto] for GH 07
    //Version written 2010 09 27 - for Grasshopper 0.7.0055

    if(obj == null) return;
    if(activate){

      //Make new attribute
      Rhino.DocObjects.ObjectAttributes att = new Rhino.DocObjects.ObjectAttributes();
      Guid o_id = default(Guid);

      //Set object name
      if(name != null && Rhino.DocObjects.Layer.IsValidName(name) == true)
      {
        att.Name = name;
      }

      //Set layer
      if(layer != null && Rhino.DocObjects.Layer.IsValidName(layer) == true){
        //Get the current layer index

        Rhino.DocObjects.Tables.LayerTable layerTable = doc.Layers;
        int layerIndex = layerTable.Find(layer, true);
        if(layerIndex == -1){ //This layer does not exist, we add it
          //make new layer
          Rhino.DocObjects.Layer myLayer = new Rhino.DocObjects.Layer();
          myLayer.Name = layer;
          //Add the layer to the layer table
          layerIndex = layerTable.Add(myLayer);

          if( layerIndex > -1 ){ //We manged to add layer!
            att.LayerIndex = layerIndex;
            __out.Add("Added new layer to the document at position " + layerIndex + " named " + layer + ". ");
          }else{
            __out.Add("Layer did not add. Try cleaning up your layers."); //This never happened to me.
          }
        }else{
          att.LayerIndex = layerIndex;
          __out.Add("Added to existing layer " + layerIndex + " named " + layer + ". ");
        }
      }

      //Set color
      if(color != null)
      {
        att.ColorSource = Rhino.DocObjects.ObjectColorSource.ColorFromObject;
        att.ObjectColor = color;
        att.PlotColorSource = Rhino.DocObjects.ObjectPlotColorSource.PlotColorFromObject;
        att.PlotColor = color;
      }

      //Bake to the right type of object
      switch (obj.ObjectType)
      {
        case Rhino.DocObjects.ObjectType.Brep:
          o_id = doc.Objects.AddBrep((Brep) obj, att);
          break;
        case Rhino.DocObjects.ObjectType.Mesh:
          o_id = doc.Objects.AddMesh((Mesh) obj, att);
          break;

        case Rhino.DocObjects.ObjectType.Point:
          o_id = doc.Objects.AddPoint(((Rhino.Geometry.Point) obj).Location, att);
          break;

        case Rhino.DocObjects.ObjectType.Curve:
          o_id = doc.Objects.AddCurve((Curve) obj, att);
          break;

        default:
          Print("I'm not sure what kind of geometry is coming in the input. Try turning it into a Point, Curve, Mesh, or Brep before the input.");
          return;
      }
      __out.Add("Added " + obj.GetType().Name);

    } else {

      Print("Inactive");
    }
# ---------- end simplebake ----------
custom_preview_3 = CustomPreview(Geometry=[dispatch_8.ListB, dispatch_9.ListB], Shader=ColourSwatch(SwatchColor=RGBA(0, 0, 255, 50)))
panel_5 = Panel(simplebake)

bnd_2 = Bounds(Numbers=dispatch_11.ListB)
dedomain_2 = DeconstructDomain(Domain=bnd_2)  # -> Start, End
gradient_2 = Gradient(LowerLimit=dedomain_2.Start, UpperLimit="0", Parameter=dispatch_11.ListB, stops=[0: RGB(0, 0, 255), 1: RGB(0, 0, 255)])
panel_6 = Panel("Compression")

gradient_3 = Gradient(LowerLimit=1, UpperLimit=1, Parameter=dispatch_7.ListA, stops=[0: RGB(255, 0, 0), 1: RGB(255, 0, 0)])
simplebake_2 = CSharpScript(obj=[dispatch_8.ListA, dispatch_9.ListA], layer="Tension", color=gradient_3)  # -> out; inputs obj: GeometryBase, name: String, layer: String, color: Color, activate: Boolean; same code as simplebake
custom_preview_4 = CustomPreview(Geometry=[dispatch_8.ListA, dispatch_9.ListA], Shader=ColourSwatch(SwatchColor=RGBA(255, 0, 0, 75)))
panel_7 = Panel(simplebake_2)

gradient_4 = Gradient(LowerLimit=1, UpperLimit=1, Parameter=dispatch_11.ListA, stops=[0: RGB(255, 0, 0), 1: RGB(255, 0, 0)])
panel_8 = Panel("Tension")

# ----
# DISPLAY NODES
python_script_8 = PythonScript(Assembly=data_2)  # -> a, nodetypes, nodestate
# ---------- python_script_8: Python ----------
import rhinoscriptsyntax as rs
import ghpythonlib.components as gh
import Rhino.Geometry as rg
import System.Drawing as sd
import math
import random

import Assembly as assembly
import Grammar as gr
import Rhino as rc
import Rules as r
import GraphicStatics as gs

reload (assembly)
reload (gs)
reload (r)



a=[]
nodetypes =[]
nodestate =[]
for i in range(0,len(Assembly.Nodes)):
    a.append(Assembly.Nodes[i].Coordinate)
    nodetypes.append(Assembly.Nodes[i].Type)
    nodestate.append(Assembly.Nodes[i].NodeState)
# ---------- end python_script_8 ----------
colour_swatch_9 = ColourSwatch(SwatchColor=RGB(255, 255, 255))

point_2 = Point(python_script_8.a)
dispatch_14 = Dispatch(List=point_2, DispatchPattern=dispatch_pattern_4)  # -> ListA, ListB
dispatch_15 = Dispatch(List=python_script_8.a, DispatchPattern=dispatch_pattern_2)  # -> ListA, ListB
python_script_9 = PythonScript(x=dispatch_14.ListA, y=Slider(1.4, range=0..2))  # -> out, a; inputs x: list
# ---------- python_script_9: Python ----------
listlength = len(x)

a = []
for i in range(0, listlength):
    if i > 9:
        a.append(y+0.8)
    else:
        a.append(y)

print a
# ---------- end python_script_9 ----------
python_script_10 = PythonScript(x=dispatch_14.ListA, y=Slider(1.4, range=0..4))  # -> out, a; inputs x: list; same code as python_script_9
unit_x_3 = UnitX(Factor=python_script_9.a)
unit_x_4 = UnitX(Factor=python_script_10.a)

circle_3 = Circle(Plane=dispatch_15.ListA, Radius=Slider(0.15, range=0..1))
createhatch_2 = CreateHatch(Bake=False, Curves=circle_3, HatchPatternName="Solid", HatchScale=1, HatchRotation=0)
custom_preview_lineweights_3 = CustomPreviewLineweights(Geometry=circle_3, Shader=colour_swatch, Thickness=Slider(6, range=0..20))
custom_preview_5 = CustomPreview(Geometry=createhatch_2, Shader=colour_swatch)

move_3 = Move(Geometry=dispatch_14.ListA, Motion=unit_x)  # -> Geometry, Transform
move_4 = Move(Geometry=dispatch_14.ListA, Motion=unit_x_3)  # -> Geometry, Transform
move_5 = Move(Geometry=dispatch_14.ListA, Motion=unit_x_4)  # -> Geometry, Transform
move_6 = Move(Geometry=move_3.Geometry, Motion=unit_y)  # -> Geometry, Transform
move_7 = Move(Geometry=move_4.Geometry, Motion=unit_y_2)  # -> Geometry, Transform
move_8 = Move(Geometry=move_5.Geometry, Motion=unit_y_3)  # -> Geometry, Transform
item_index_3 = ItemIndex(List=move_6.Geometry, Item=move_6.Geometry)
concatenate_2 = Concatenate(FragmentA="Type:", FragmentB=python_script_8.nodetypes)
concatenate_3 = Concatenate(FragmentA="State:", FragmentB=python_script_8.nodestate)
text_tag_3d_6 = TextTag3D(
    Location=move_7.Geometry,
    Text=concatenate_2,
    Size=Slider(0.35, range=0.1..2),
    Colour=ColourSwatch(SwatchColor=RGB(0, 137, 158)),
    Justification=7)
text_tag_3d_7 = TextTag3D(
    Location=move_8.Geometry,
    Text=concatenate_3,
    Size=Slider(0.35, range=0.1..2),
    Colour=ColourSwatch(SwatchColor=RGB(137, 64, 148)),
    Justification=7)
text_tag_3d_8 = TextTag3D(
    Location=move_6.Geometry,
    Text=item_index_3,
    Size=Slider(1, range=1..5),
    Colour=ColourSwatch(SwatchColor=RGB(191, 191, 191)),
    Justification=7)

# ==== cluster ForceDisplay
force_type = ClusterInput()
tension_compresion = ClusterInput()
line = ClusterInput()
colour = ClusterInput()
force_type_2 = Number(force_type)
tension_compresion_2 = Number(tension_compresion)
line_2 = Line(line)
end_points = EndPoints(Curve=line_2)  # -> Start, End
equality = Equality(FirstNumber=tension_compresion_2, SecondNumber=1)  # -> Equality, Inequality
equality_2 = Equality(FirstNumber=tension_compresion_2, SecondNumber=-1)  # -> Equality, Inequality
vector_2pt = Vector2Pt(PointA=end_points.End, PointB=end_points.Start, Unitize=False)  # -> Vector, Length
dispatch = Dispatch(List="1", DispatchPattern=equality.Equality)  # -> ListA, ListB
dispatch_2 = Dispatch(List="2", DispatchPattern=equality_2.Equality)  # -> ListA, ListB
colour_2 = Colour(colour)
radians = Radians(Degrees="15")
rotate = Rotate(Geometry=vector_2pt.Vector, Angle=radians, Plane=PlaneXY(0, 0, 0))  # -> Geometry, Transform
rotate_2 = Rotate(Geometry=vector_2pt.Vector, Angle=expr("x*-1", radians), Plane=PlaneXY(0, 0, 0))  # -> Geometry, Transform

amplitude = Amplitude(Vector=vector_2pt.Vector, Amplitude="1")
move = Move(Geometry=end_points.End, Motion=amplitude)  # -> Geometry, Transform

line_3 = Line(StartPoint=end_points.Start, EndPoint=move.Geometry)
custom_preview_lineweights = CustomPreviewLineweights(Geometry=line_3, Shader=colour_2, Thickness=[dispatch.ListA, dispatch_2.ListA])
amplitude_2 = Amplitude(Vector=rotate.Geometry, Amplitude="1.5")
amplitude_3 = Amplitude(Vector=rotate_2.Geometry, Amplitude="1.5")
move_2 = Move(Geometry=end_points.End, Motion=amplitude_3)  # -> Geometry, Transform
move_3 = Move(Geometry=end_points.End, Motion=amplitude_2)  # -> Geometry, Transform
point = Point(end_points.End)
polyline = PolyLine(Vertices=[point, move_2.Geometry, move.Geometry, move_3.Geometry], Closed=True)
createhatch = CreateHatch(Bake=False, Curves=polyline, HatchPatternName="Hatch1", HatchScale=0.01, HatchRotation=0)
custom_preview_lineweights_2 = CustomPreviewLineweights(Geometry=polyline, Shader=colour_2, Thickness=1)
custom_preview = CustomPreview(Geometry=createhatch, Shader=colour_2)

# ==== cluster PINSUPPORT
support_location = ClusterInput()
color = ClusterInput()
lineweight_scale = ClusterInput()
visual_scale = ClusterInput()

# ---- group: SUPPORT LOCATION
support_location_2 = Point(support_location)

# ----
color_2 = Colour(color)

# ---- group: VISUAL SCALE
multiplication = Multiplication(A=1, VisualScale=visual_scale)

# ---- group: LINEWEIGHT
multiplication_2 = Multiplication(A=1, LineweightScale=lineweight_scale)

# ----
deconstruct = Deconstruct(Point=support_location_2)  # -> XComponent, YComponent, ZComponent
construct_point = ConstructPoint(XCoordinate=expr("X+0.6", deconstruct.XComponent), YCoordinate=expr("X-1", deconstruct.YComponent), ZCoordinate=0)
construct_point_2 = ConstructPoint(XCoordinate=expr("X-0.6", deconstruct.XComponent), YCoordinate=expr("X-1", deconstruct.YComponent), ZCoordinate=0)
construct_point_3 = ConstructPoint(XCoordinate=expr("X+1", deconstruct.XComponent), YCoordinate=expr("X-1", deconstruct.YComponent), ZCoordinate=0)
construct_point_4 = ConstructPoint(XCoordinate=expr("X-1", deconstruct.XComponent), YCoordinate=expr("X-1", deconstruct.YComponent), ZCoordinate=0)
construct_point_5 = ConstructPoint(XCoordinate=expr("X+1", deconstruct.XComponent), YCoordinate=expr("X-1.5", deconstruct.YComponent), ZCoordinate=0)
construct_point_6 = ConstructPoint(XCoordinate=expr("X-1", deconstruct.XComponent), YCoordinate=expr("X-1.5", deconstruct.YComponent), ZCoordinate=0)

# ---- group: Triangle
polyline = PolyLine(Vertices=[support_location_2, construct_point_2, construct_point], Closed=True)

# ----
polyline_2 = PolyLine(Vertices=[construct_point_3, construct_point_4, construct_point_6, construct_point_5], Closed=True)
line = Line(StartPoint=construct_point_3, EndPoint=construct_point_4)
createhatch = CreateHatch(Bake=False, Curves=polyline_2, HatchPatternName="Hatch1", HatchScale=1, HatchRotation=expr("45*pi/180", 0))

scale = Scale(Geometry=polyline, Center=support_location_2, Factor=multiplication)  # -> Geometry, Transform
scale_2 = Scale(Geometry=createhatch, Center=support_location_2, Factor=multiplication)  # -> Geometry, Transform
multiplication_3 = Multiplication(A=2, B=multiplication_2)
multiplication_4 = Multiplication(A=1, B=multiplication_2)
custom_preview_lineweights = CustomPreviewLineweights(Geometry=scale.Geometry, Shader=color_2, Thickness=multiplication_3)
custom_preview_lineweights_2 = CustomPreviewLineweights(Geometry=scale_2.Geometry, Shader=color_2, Thickness=multiplication_4)

scale_3 = Scale(Geometry=line, Center=support_location_2, Factor=multiplication)  # -> Geometry, Transform
multiplication_5 = Multiplication(A=4, B=multiplication_2)
custom_preview_lineweights_3 = CustomPreviewLineweights(Geometry=scale_3.Geometry, Shader=color_2, Thickness=multiplication_5)

# ==== cluster Cluster
line = ClusterInput()
line_2 = Line(line)
vector = Vector(line_2)
end_points = EndPoints(Curve=line_2)  # -> Start, End
vector_display_ex = VectorDisplayEx(Point=end_points.Start, Vector=vector, Colour=ColourSwatch(SwatchColor=RGB(100, 0, 38)), Width=1)

# ==== cluster Cluster_2
line = ClusterInput()
line_2 = Line(line)
vector = Vector(line_2)
end_points = EndPoints(Curve=line_2)  # -> Start, End
colour_swatch = ColourSwatch(SwatchColor=RGB(225, 212, 38))
force_display = ForceDisplay_2(line=graft(line_2), force_type="1", tension_compresion="1", colour=colour_swatch)
vector_display_ex = VectorDisplayEx(Point=end_points.Start, Vector=vector, Colour=colour_swatch, Width=2)  # disabled

# ==== cluster ForceDisplay_3
force_type = ClusterInput()
tension_compresion = ClusterInput()
line = ClusterInput()
colour = ClusterInput()
force_type_2 = Number(force_type)
tension_compresion_2 = Number(tension_compresion)
line_2 = Line(line)
end_points = EndPoints(Curve=line_2)  # -> Start, End
equality = Equality(FirstNumber=tension_compresion_2, SecondNumber=1)  # -> Equality, Inequality
equality_2 = Equality(FirstNumber=tension_compresion_2, SecondNumber=-1)  # -> Equality, Inequality
vector_2pt = Vector2Pt(PointA=end_points.End, PointB=end_points.Start, Unitize=False)  # -> Vector, Length
dispatch = Dispatch(List="1", DispatchPattern=equality.Equality)  # -> ListA, ListB
dispatch_2 = Dispatch(List="2", DispatchPattern=equality_2.Equality)  # -> ListA, ListB
colour_2 = Colour(colour)
radians = Radians(Degrees="13")
rotate = Rotate(Geometry=vector_2pt.Vector, Angle=radians, Plane=PlaneXY(0, 0, 0))  # -> Geometry, Transform
rotate_2 = Rotate(Geometry=vector_2pt.Vector, Angle=expr("x*-1", radians), Plane=PlaneXY(0, 0, 0))  # -> Geometry, Transform

amplitude = Amplitude(Vector=vector_2pt.Vector, Amplitude="0.8")
move = Move(Geometry=end_points.End, Motion=amplitude)  # -> Geometry, Transform

line_3 = Line(StartPoint=end_points.Start, EndPoint=move.Geometry)
custom_preview_lineweights = CustomPreviewLineweights(Geometry=line_3, Shader=colour_2, Thickness=[dispatch.ListA, dispatch_2.ListA])
amplitude_2 = Amplitude(Vector=rotate.Geometry, Amplitude="1")
amplitude_3 = Amplitude(Vector=rotate_2.Geometry, Amplitude="1")
move_2 = Move(Geometry=end_points.End, Motion=amplitude_3)  # -> Geometry, Transform
move_3 = Move(Geometry=end_points.End, Motion=amplitude_2)  # -> Geometry, Transform
point = Point(end_points.End)
polyline = PolyLine(Vertices=[point, move_2.Geometry, move.Geometry, move_3.Geometry], Closed=True)
createhatch = CreateHatch(Bake=False, Curves=polyline, HatchPatternName="Hatch1", HatchScale=0.01, HatchRotation=0)
custom_preview_lineweights_2 = CustomPreviewLineweights(Geometry=polyline, Shader=colour_2, Thickness=1)
custom_preview = CustomPreview(Geometry=createhatch, Shader=colour_2)

# ==== cluster ForceDisplay_2
force_type = ClusterInput()
tension_compresion = ClusterInput()
line = ClusterInput()
colour = ClusterInput()
force_type_2 = Number(force_type)
tension_compresion_2 = Number(tension_compresion)
line_2 = Line(line)
end_points = EndPoints(Curve=line_2)  # -> Start, End
equality = Equality(FirstNumber=tension_compresion_2, SecondNumber=1)  # -> Equality, Inequality
vector_2pt = Vector2Pt(PointA=end_points.End, PointB=end_points.Start, Unitize=False)  # -> Vector, Length
dispatch = Dispatch(List="3", DispatchPattern=equality.Equality)  # -> ListA, ListB
colour_2 = Colour(colour)
radians = Radians(Degrees="15")
rotate = Rotate(Geometry=vector_2pt.Vector, Angle=radians, Plane=PlaneXY(0, 0, 0))  # -> Geometry, Transform
rotate_2 = Rotate(Geometry=vector_2pt.Vector, Angle=expr("x*-1", radians), Plane=PlaneXY(0, 0, 0))  # -> Geometry, Transform

amplitude = Amplitude(Vector=vector_2pt.Vector, Amplitude="1.5")
move = Move(Geometry=end_points.End, Motion=amplitude)  # -> Geometry, Transform

line_3 = Line(StartPoint=end_points.Start, EndPoint=move.Geometry)
custom_preview_lineweights = CustomPreviewLineweights(Geometry=line_3, Shader=colour_2, Thickness=dispatch.ListA)
amplitude_2 = Amplitude(Vector=rotate.Geometry, Amplitude="2")
amplitude_3 = Amplitude(Vector=rotate_2.Geometry, Amplitude="2")
move_2 = Move(Geometry=end_points.End, Motion=amplitude_3)  # -> Geometry, Transform
move_3 = Move(Geometry=end_points.End, Motion=amplitude_2)  # -> Geometry, Transform
point = Point(end_points.End)
polyline = PolyLine(Vertices=[point, move_2.Geometry, move.Geometry, move_3.Geometry], Closed=True)
createhatch = CreateHatch(Bake=False, Curves=polyline, HatchPatternName="Solid", HatchScale=1, HatchRotation=0)
custom_preview_lineweights_2 = CustomPreviewLineweights(Geometry=polyline, Shader=colour_2, Thickness=1)
custom_preview = CustomPreview(Geometry=createhatch, Shader=colour_2)
