# Grasshopper definition 240411_QLA Integrated.gh (Grasshopper 1.0.7)
# plug-ins: Human

# ---- group: Head
pt = Point(<point referenced from the Rhino model>)

# ----
node_type = ValueList({"Support": "1", "Load": "2", "Float": "3", "End": "4", "Corner": "5", "Tri": "6", "Quad": "7"}, selected="Load")
tail = Point(<point referenced from the Rhino model>)
make_node = MakeNode(tail=tail, head=pt, type=node_type)

# ---- group: Head
pt_2 = Point(<point referenced from the Rhino model>)

# ----
node_type_2 = ValueList({"Support": "1", "Load": "2", "Float": "3", "End": "4", "Corner": "5", "Tri": "6", "Quad": "7"}, selected="Load")
tail_2 = Point(<point referenced from the Rhino model>)
make_node_2 = MakeNode(tail=tail_2, head=pt_2, type=node_type_2)

# ---- group: Head
pt_3 = Point(<point referenced from the Rhino model>)

# ----
node_type_3 = ValueList({"Support": "1", "Load": "2", "Float": "3", "End": "4", "Corner": "5", "Tri": "6", "Quad": "7"}, selected="Support")
tail_3 = Point(<point referenced from the Rhino model>)
make_node_3 = MakeNode(tail=tail_3, head=pt_3, type=node_type_3)

# ---- group: Head
pt_4 = Point(<point referenced from the Rhino model>)

# ----
node_type_4 = ValueList({"Support": "1", "Load": "2", "Float": "3", "End": "4", "Corner": "5", "Tri": "6", "Quad": "7"}, selected="Support")
tail_4 = Point(<point referenced from the Rhino model>)
make_node_4 = MakeNode(tail=tail_4, head=pt_4, type=node_type_4)

node_type_5 = ValueList({"Support": "1", "Load": "2", "Float": "3", "End": "4", "Corner": "5", "Tri": "6", "Quad": "7"}, selected="Support")
node_type_6 = ValueList({"Support": "1", "Load": "2", "Float": "3", "End": "4", "Corner": "5", "Tri": "6", "Quad": "7"}, selected="Support")
node_type_7 = ValueList({"Support": "1", "Load": "2", "Float": "3", "End": "4", "Corner": "5", "Tri": "6", "Quad": "7"}, selected="Load")

# ----
# BOUNDARY
crv = Curve(<curve referenced from the Rhino model>)

tail_5 = Point(<point referenced from the Rhino model>)
pt_5 = Point(<point referenced from the Rhino model>)
make_node_5 = MakeNode(tail=tail_5, head=pt_5, type=node_type_5)

tail_6 = Point(<point referenced from the Rhino model>)
pt_6 = Point(<point referenced from the Rhino model>)
make_node_6 = MakeNode(tail=tail_6, head=pt_6, type=node_type_6)

tail_7 = Point(<point referenced from the Rhino model>)
pt_7 = Point(<point referenced from the Rhino model>)
make_node_7 = MakeNode(tail=tail_7, head=pt_7, type=node_type_7)

# ----
# BOUNDARY
crv_2 = Curve(<curve referenced from the Rhino model>)

data = Data([make_node_5, make_node_6])

data_2 = Data(make_node_7)

data_3 = Data(crv_2)

makeassembly = MakeAssembly(loads=data, supports=data_2, boundary=data_3)

data_4 = Data([make_node_3, make_node_4])

data_5 = Data(crv)

data_6 = Data([make_node, make_node_2])

# ---- group: Make Assembly
makeassembly_2 = MakeAssembly(loads=data_6, supports=data_4, boundary=data_5)

# ----
data_7 = Data(makeassembly)
data_8 = Data(data_7)
python_script = PythonScript(StartShape=data_7)  # -> a; disabled
# ---------- python_script: Python ----------
import rhinoscriptsyntax as rs
import ghpythonlib.components as gh
import Rhino.Geometry as rg
import System.Drawing as sd
import math
import random

import Assembly as assembly
import Grammar as gr
import Rhino as rc
import Rules as rules
import GraphicStatics as gs
import GoCode as gc

reload (assembly)
reload (gs)
reload (rules)
reload (gr)
reload (gc)

a = gc.Generate(StartShape)
# ---------- end python_script ----------
qla_instance = GhPythonScript(StartShape=data_8)  # -> out, Environment, Agent
# ---------- qla_instance: Python ----------
import rhinoscriptsyntax as rs
import ghpythonlib.components as gh
import Rhino.Geometry as rg
import System.Drawing as sd
import math
import random
import copy

################################################################################
#  IMPORT JUNEY FILES
################################################################################
import Assembly as assembly
import Grammar as gr
import Rhino as rc
import Rules as rules
import GraphicStatics as gs

import RandomUtility as ru

import QLA_231127 as qa

reload (assembly)
reload (gs)
reload (rules)
reload (gr)


reload (qa)


################################################################################
#  Instantiate ML classes
################################################################################

mygrammar = gr.Grammar()
randcomp = gr.RandomComputation(mygrammar)


env = qa.Environment(mygrammar, randcomp, StartShape)

agent = qa.QLearningAgent(randcomp, env)

# Test code here


# Output
Environment = env
Agent = agent
# ---------- end qla_instance ----------

python_script_2 = PythonScript(StartShape=data_7)  # -> simplify(nodenames), pts, history, b, c, projection; disabled
# ---------- python_script_2: Python ----------
import rhinoscriptsyntax as rs
import ghpythonlib.components as gh
import Rhino.Geometry as rg
import System.Drawing as sd
import math
import random

import Assembly as assembly
import Grammar as gr
import Rhino as rc
import Rules as rules
import GraphicStatics as gs

reload (assembly)
reload (gs)
reload (rules)
reload (gr)



node = StartShape.Nodes[2]
b = gh.Circle(node.Coordinate, 2.5)



"""
node2 = gs.FindClosestNodes(node, StartShape, 3)
print node2


d = gs.FindClosestProjections(node, StartShape, 1)
projection = d[1]
print d
"""
# ---------- end python_script_2 ----------
python_script_3 = PythonScript(StartShape=data_7)  # -> a, history, bestDesigns; disabled
# ---------- python_script_3: Python ----------
import rhinoscriptsyntax as rs
import ghpythonlib.components as gh
import Grasshopper as Grasshopper
import Rhino.Geometry as rg
import System.Drawing as sd
import math
import random

import Assembly as assembly
import Grammar as gr
import Rhino as rc
import Rules as rules
import GraphicStatics as gs

reload (assembly)
reload (gs)
reload (rules)
reload (gr)


g = gr.Grammar()
b = gr.RandomComputation(g)
a = b.GenerateRandomAssembly(StartShape)

NUM = 4
bestNum = 5
bestDesigns = []



"""
for i in range(NUM):

    history = []

    
    a = b.GenerateRandomAssembly(StartShape)
    print a
    bestDesigns.append(a)
    
    
    for obj in ghenv.Component.OnPingDocument().Objects:
        if obj.NickName == "MakeAssembly":
            obj.ExpireSolution(False)
    
    
    for t in a.History.Rules:
        c = t[2].Name, "applied at Node", t[0]
        history.append(c)
    
    if len(bestDesigns) < bestNum:
        bestDesigns.append(a)
    else:
        bestDesigns.append(a)
        sorted(bestDesigns, key=lambda a: a.Score, reverse=False)
        bestDesigns.remove(bestDesigns[-1])
        """
# ---------- end python_script_3 ----------
python_script_4 = PythonScript(StartShape=data_7)  # -> simplify(nodenames), pts, history, b, c; disabled
# ---------- python_script_4: Python ----------
import rhinoscriptsyntax as rs
import ghpythonlib.components as gh
import Rhino.Geometry as rg
import System.Drawing as sd
import math
import random

import Assembly as assembly
import Grammar as gr
import Rhino as rc
import Rules as rules
import GraphicStatics as gs

reload (assembly)
reload (gs)
reload (rules)
reload (gr)


nodenames = StartShape.Nodes
pts =[]
for node in nodenames:
    pts.append(node.Coordinate)
print nodenames


node = StartShape.Nodes[0]
b = gh.Circle(node.Coordinate, 2.5)
print gs.GetNodeIndex(node, StartShape)
print node




a = gs.FindClosestNode(node, StartShape)
c = gh.Circle(a[0].Coordinate, 5)

print a[1]

print nodenames
# ---------- end python_script_4 ----------
python_script_5 = PythonScript(x=data_7)  # -> a; disabled
# ---------- python_script_5: Python ----------
a = []
for t in x.History.Rules:
    b = t[2].Name, 'applied at Node', t[0]
    a.append(b)
# ---------- end python_script_5 ----------
pt_8 = Point(python_script_2.projection)  # disabled

qla_start = GhPythonScript(env=qla_instance.Environment, agent=qla_instance.Agent)  # -> out, Environment, Agent, a
# ---------- qla_start: Python ----------
import rhinoscriptsyntax as rs
import ghpythonlib.components as gh
import Rhino.Geometry as rg
import System.Drawing as sd
import math
import random

################################################################################
#  IMPORT JUNEY FILES
################################################################################
import Assembly as assembly
import Grammar as gr
import Rhino as rc
import Rules as rules
import GraphicStatics as gs

import RandomUtility as ru

import QLA_231127 as qa

reload (assembly)
reload (gs)
reload (rules)
reload (gr)


reload (qa)

################################################################################
#  Code for ML 
################################################################################
env.reset()

a = [n.Coordinate for n in env.assembly.Nodes]
################################################################################
#  Output
################################################################################

Environment = env
Agent = agent
# ---------- end qla_start ----------
panel = Panel(python_script)  # disabled
data_9 = Data(qla_start.a)
qla_start_2 = GhPythonScript(env=qla_start.Environment, agent=qla_start.Agent)  # -> out, Environment, Agent, assembly, a; disabled
# ---------- qla_start_2: Python ----------
import rhinoscriptsyntax as rs
import ghpythonlib.components as gh
import Rhino.Geometry as rg
import System.Drawing as sd
import math
import random

################################################################################
#  IMPORT JUNEY FILES
################################################################################
import Assembly as assembly
import Grammar as gr
import Rhino as rc
import Rules as rules
import GraphicStatics as gs

import RandomUtility as ru

import QLA_231127 as qa

reload (assembly)
reload (gs)
reload (rules)
reload (gr)


reload (qa)

################################################################################
#  Code for ML 
################################################################################

env.reset()
assembly = env.assembly
env.start()

state = env.get_state()
action = agent.select_action(state)
step, reward, done = env.step(action)
next_state = env.get_state()

agent.update(state, action, reward, next_state)



lists = []
for s in state:
    lists.append("{x}{y}".format(x=s[0], y=s[2]))
stup = (tuple(lists))


action_key = (action[0], action[-1])

print action_key
#print state

Environment = env
Agent = agent

a = []
for s in state:
    #for x in s:
    text = (s[0], s[2])
    a.append(text)
#[node.Coordinate for node in assembly.Nodes]
# ---------- end qla_start_2 ----------
loop = GhPythonScript(run=Toggle(True), episodes="5", env=qla_start.Environment, agent=qla_start.Agent, target_length="50")  # -> out, state, assembly, done, action, applicablerules, active_nodes, members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; inputs run: Boolean, episodes: Int32, target_length: Int32, designs: list
# ---------- loop: Python ----------
import rhinoscriptsyntax as rs
import ghpythonlib.components as gh
import Rhino.Geometry as rg
import System.Drawing as sd
import math
import random
import copy

################################################################################
#  IMPORT JUNEY FILES
################################################################################
import Assembly as assembly
import Grammar as gr
import Rhino as rc
import Rules as rules
import GraphicStatics as gs

import RandomUtility as ru

import QLA_231127 as qa
import scriptcontext 

reload (assembly)
reload (gs)
reload (rules)
reload (gr)


reload (qa)

################################################################################
#  Code for ML 
################################################################################
if run:
    scriptcontext.sticky['assembly_list'] = []
    scriptcontext.sticky['assembly_length'] = []
    
    env.input_length = target_length
    
    agent.train(episodes)


################################################################################
#  Output
################################################################################
'''rules = []
for rule in state:
    rules.append(rule[0])
 
print len(state)
applicablerules = rules'''

"""q_table_df = pd.DataFrame(agent.q_table)
print (q_table_df)"""

assemblies = scriptcontext.sticky['assembly_list']
length = scriptcontext.sticky['assembly_length']

activenodes = gs.GetActiveNodes(env.assembly)
active_nodes=[]
for node in activenodes:
    #force = gs.GetTempForce(node)[0]
    active_nodes.append(node.Coordinate)

assembly = env.assembly
done = env.is_done()
active_nodes
members = env.assembly.Members
history = env.assembly.History.Rules

Environment = env
Agent = agent
#rewards = agent.episode_rewards
# ---------- end loop ----------
qla_start_3 = GhPythonScript(env=qla_start_2.Environment, agent=qla_start_2.Agent)  # -> out, Environment, Agent, assembly, a; disabled
# ---------- qla_start_3: Python ----------
import rhinoscriptsyntax as rs
import ghpythonlib.components as gh
import Rhino.Geometry as rg
import System.Drawing as sd
import math
import random

################################################################################
#  IMPORT JUNEY FILES
################################################################################
import Assembly as assembly
import Grammar as gr
import Rhino as rc
import Rules as rules
import GraphicStatics as gs

import RandomUtility as ru

import QLA_231127 as qa

reload (assembly)
reload (gs)
reload (rules)
reload (gr)


reload (qa)

################################################################################
#  Code for ML 
################################################################################



state = env.get_state()
action = agent.select_action(state)
step, reward, done = env.step(action)
next_state = env.get_state()

agent.update(state, action, reward, next_state)

Environment = env
Agent = agent 
assembly = env.assembly

lists = []
for s in state:
    lists.append("{x}{y}".format(x=s[0], y=s[2]))
stup = (tuple(lists))

a = stup
action_key = (action[0], action[-1])

print action_key



#print state
# ---------- end qla_start_3 ----------
data_10 = Data(qla_start_2.a)  # disabled
lng = ListLength(List=loop.assemblies)
panel_2 = Panel(data_10)  # disabled
item = ListItem(List=loop.assemblies, Index=Slider(3, range=0..10), Wrap=True)
qla_start_4 = GhPythonScript(env=qla_start_3.Environment, agent=qla_start_3.Agent)  # -> out, Environment, Agent, test, assembly; disabled
# ---------- qla_start_4: Python ----------
import rhinoscriptsyntax as rs
import ghpythonlib.components as gh
import Rhino.Geometry as rg
import System.Drawing as sd
import math
import random

################################################################################
#  IMPORT JUNEY FILES
################################################################################
import Assembly as assembly
import Grammar as gr
import Rhino as rc
import Rules as rules
import GraphicStatics as gs

import RandomUtility as ru

import QLA_231125 as qa

reload (assembly)
reload (gs)
reload (rules)
reload (gr)


reload (qa)

################################################################################
#  IMPORT RHINOREMOTE
################################################################################

import scriptcontext
import ghpythonremote
np = scriptcontext.sticky['numpy']
rpy = scriptcontext.sticky['rpy']


import ghpythonlib.treehelpers as th

################################################################################
#  Code for ML 
################################################################################



state = env.get_state()
action = agent.select_action(state)
step, reward, done = env.step(action)
next_state = env.get_state()

agent.update(state, action, reward, next_state)

Environment = env
Agent = agent 
assembly = env.assembly

lists = []
for s in state:
    lists.append("{x}{y}".format(x=s[0], y=s[2]))
stup = (tuple(lists))

a = len(stup)
action_key = (action[0], action[-1])

#print action_key

test = stup

print action_key
# ---------- end qla_start_4 ----------
no_of_designs = Panel(lng)
panel_3 = Panel(loop.out)
python = GhPythonScript()  # -> Out, A
data_11 = Data(loop.assembly)

# ---- group: Assembly
data_12 = Data(data_11)

# ----
toggle = BooleanToggle(True)

# ----
# DISPLAY TEMP FORCES
dispatch = Dispatch(List=data_12, DispatchPattern=Toggle(True))  # -> ListA, ListB

dispatch_2 = Dispatch(List=data_12, DispatchPattern=Toggle(True))  # -> ListA, ListB

# ----
# DISPLAY NODES
python_script_6 = PythonScript(Assembly=data_12)  # -> a, nodetypes, nodestate
# ---------- python_script_6: Python ----------
import rhinoscriptsyntax as rs
import ghpythonlib.components as gh
import Rhino.Geometry as rg
import System.Drawing as sd
import math
import random

import Assembly as assembly
import Grammar as gr
import Rhino as rc
import Rules as r
import GraphicStatics as gs

reload (assembly)
reload (gs)
reload (r)



a=[]
nodetypes =[]
nodestate =[]
for i in range(0,len(Assembly.Nodes)):
    a.append(Assembly.Nodes[i].Coordinate)
    nodetypes.append(Assembly.Nodes[i].Type)
    nodestate.append(Assembly.Nodes[i].NodeState)
# ---------- end python_script_6 ----------
dispatch_3 = Dispatch(List=python_script_6.a, DispatchPattern=Toggle(True))  # -> ListA, ListB
cir = Circle(Plane=dispatch_3.ListA, Radius=Slider(0.15, range=0..1))
createhatch = CreateHatch(Bake=False, Curves=cir, HatchPatternName="Solid", HatchScale=1, HatchRotation=0)  # -> HatchGeometry, HatchObjects
swatch = ColourSwatch(SwatchColor=RGB(0, 0, 0))

# ----
# DISPLAY RULE HISTORY
dispatch_4 = Dispatch(List=data_12, DispatchPattern=Toggle(True))  # -> ListA, ListB
python_script_7 = PythonScript(Assembly=dispatch_4.ListA)  # -> pt, ptlist, history, indexlist, colorlist, historywithindex
# ---------- python_script_7: Python ----------
import rhinoscriptsyntax as rs
import ghpythonlib.components as gh
import Rhino.Geometry as rg
import System.Drawing as sd
import math
import random

import Assembly as assembly
import Grammar as gr
import Rhino as rc
import Rules as rules
import GraphicStatics as gs

reload (assembly)
reload (gs)
reload (rules)
reload (gr)


#boundary points
nodecount = len(Assembly.Nodes)
boundary = Assembly.Boundary
boundarypts = gh.DeconstructBrep(boundary)[2]

colors = [
"219, 107,4",
"225, 212,0",
"140, 198, 63",
"58, 178, 221",
"0, 105, 151",
"216, 75, 141",
"146, 10, 120"]

"""
0. Orange = "219, 107,4"

1. Yellow = "225, 212,0"
2. Green = "140, 198, 63"
3. Sky = "58, 178, 221"
4. Blue = "0, 105, 151"
5. Magenta = "216, 75, 141"

6. Purple = "146, 10, 120"
"""

################################################################################
x = []
y = []
for pt in boundarypts:
    x.append(pt.X)
    y.append(pt.Y)

x = gh.SortList(x)[0]
y = gh.SortList(y)[0]

pt = rg.Point3d(x[-1]+10, y[-1], 0)
pt1 = rg.Point3d(x[-1]+10, y[-1]-3, 0)

################################################################################

history = []
for t in Assembly.History.Rules:
    b = t[2].Name, 'applied at Node', t[0]
    history.append(b)

print history[-1]
################################################################################

ptlist = []
ptlist.append(pt1)

vector = gh.UnitY(-1.5)
for i in range(0,len(history)-1):
    mpt = gh.Move(ptlist[-1], vector)[0]
    ptlist.append(mpt)

################################################################################

colorlist = []
for i in range(0,len(history)):
    if history[i][0] == "Rule 0: 'START'":
        colorlist.append(colors[0]) #0. Orange = 219, 107,4

    elif history[i][0] == "Rule 1: 'Create Node'":
        colorlist.append(colors[1]) #1. Yellow = 225, 212,0

    elif history[i][0] == "Rule 2: 'Extend Node'":
        colorlist.append(colors[2]) #2. Green = 140, 198, 63

    elif history[i][0] == "Rule 3: 'Split Node'":
        colorlist.append(colors[3]) #3. Sky = 58, 178, 221

    elif history[i][0] == "Rule 4: 'Connect with Element'":
        colorlist.append(colors[4]) #4. Blue = 0, 105, 151

    elif history[i][0] == "Rule 5: 'Connect via Projection'":
        colorlist.append(colors[5]) #5. Magenta = 216, 75, 141

    if history[i][0] == "Rule 7: 'System Close'" or history[i][0] == "Rule 8: 'END'":
        colorlist.append(colors[6]) #6. Purple = 146, 10, 120



################################################################################

indexlist = []
historywithindex = []
for i in range(0,len(history)):
    indexlist.append((i+1,'.'))
    c = (indexlist[i], history[i])
    historywithindex.append(c)
# ---------- end python_script_7 ----------
rep = ReplaceText(Text=flatten(python_script_7.historywithindex), Find="(", RecursiveReplace=False)
rep_2 = ReplaceText(Text=flatten(rep), Find=")", RecursiveReplace=False)
rep_3 = ReplaceText(Text=flatten(rep_2), Find="'", RecursiveReplace=False)
rep_4 = ReplaceText(Text=flatten(rep_3), Find=",", RecursiveReplace=False)
tag = TextTag3D(
    Location=python_script_7.pt,
    Text="RULE HISTORY",
    Size=1.5,
    Colour=ColourSwatch(SwatchColor=RGB(102, 102, 102)),
    Justification=1)
tag_2 = TextTag3D(Location=python_script_7.ptlist, Text=rep_4, Size=0.75, Colour=python_script_7.colorlist, Justification=1)

# ---- group: DISPLAY TEMP FORCES
python_script_8 = PythonScript(Assembly=dispatch.ListA)  # -> a, NodeTempForces, TempForceLines
# ---------- python_script_8: Python ----------
import rhinoscriptsyntax as rs
import ghpythonlib.components as gh
import Rhino.Geometry as rg
import System.Drawing as sd
import math
import random

import Assembly as assembly
import Grammar as gr
import Rhino as rc
import Rules as r
import GraphicStatics as gs

reload (assembly)
reload (gs)
reload (r)


nodes = []
for node in Assembly.Nodes:
    nodes.append(node.Coordinate)


TempForceLines = []
for node in Assembly.Nodes: # for every node
    for i in range(0,len(node.Forces)): #for every force at node
        if node.Forces[i].Type == 3: #if the force is a temporary force
            TempForceLines.append(node.Forces[i].Line)

print TempForceLines
# ---------- end python_script_8 ----------

# ---- group: FORM DIAGRAM - VISUAL SCALE
number_slider = Slider(1.5, range=0.1..5)

# ----
entwine = Entwine(Branch00=Slider(0, range=0..360), Branch01=Slider(283, range=0..360), FlattenInputs=True)

# ---- group: LINEWEIGHT
number_slider_2 = Slider(1, range=1..10)

# ----
# DISPLAY SUPPORTS
dispatch_5 = Dispatch(List=data_12, DispatchPattern=Toggle(True))  # -> ListA, ListB
python_script_9 = PythonScript(Assembly=dispatch_5.ListA)  # -> a
# ---------- python_script_9: Python ----------
import rhinoscriptsyntax as rs
import ghpythonlib.components as gh
import Rhino.Geometry as rg
import System.Drawing as sd
import math
import random

import Assembly as assembly
import Grammar as gr
import Rhino as rc
import Rules as r
import GraphicStatics as gs

reload (assembly)
reload (gs)
reload (r)

a=[]
for i in range(0,len(Assembly.Nodes)):
    if Assembly.Nodes[i].Type == 1:
        a.append(Assembly.Nodes[i].Coordinate)
# ---------- end python_script_9 ----------
pin_support = PINSUPPORT(
    support_location=graft(python_script_9),
    rotation=entwine,
    color=ColourSwatch(SwatchColor=RGB(0, 0, 0)),
    lineweight_scale=number_slider_2,
    visual_scale=number_slider)

pt_9 = Point(python_script_6.a)
dispatch_6 = Dispatch(List=pt_9, DispatchPattern=Toggle(False))  # -> ListA, ListB

# ---- group: Display Temp Forces
cluster = Cluster(line=python_script_8.TempForceLines)

# ----
# Node Number
number_slider_3 = Slider(0.4, range=0..1)
X = UnitX(Factor=number_slider_3)
move = Move(Geometry=dispatch_6.ListA, Motion=X)  # -> Geometry, Transform
Y = UnitY(Factor=number_slider_3)
move_2 = Move(Geometry=move.Geometry, Motion=Y)  # -> Geometry, Transform
index = ItemIndex(List=move_2.Geometry, Item=move_2.Geometry)

# ----
# Node State
number_slider_4 = Slider(1.4, range=0..4)
python_script_10 = PythonScript(x=dispatch_6.ListA, y=number_slider_4)  # -> out, a; inputs x: list
# ---------- python_script_10: Python ----------
listlength = len(x)

a = []
for i in range(0, listlength):
    if i > 9:
        a.append(y+0.8)
    else:
        a.append(y)

print a
# ---------- end python_script_10 ----------
X_2 = UnitX(Factor=python_script_10.a)
move_3 = Move(Geometry=dispatch_6.ListA, Motion=X_2)  # -> Geometry, Transform
Y_2 = UnitY(Factor=Slider(0.4, range=0..1))
move_4 = Move(Geometry=move_3.Geometry, Motion=Y_2)  # -> Geometry, Transform
concat = Concatenate(FragmentA="State:", FragmentB=python_script_6.nodestate)

# ----
# Node Type
number_slider_5 = Slider(1.03, range=0..2)
python_script_11 = PythonScript(x=dispatch_6.ListA, y=Slider(1.4, range=0..2))  # -> out, a; inputs x: list; same code as python_script_10
X_3 = UnitX(Factor=python_script_11.a)
move_5 = Move(Geometry=dispatch_6.ListA, Motion=X_3)  # -> Geometry, Transform
Y_3 = UnitY(Factor=number_slider_5)
move_6 = Move(Geometry=move_5.Geometry, Motion=Y_3)  # -> Geometry, Transform
concat_2 = Concatenate(FragmentA="Type:", FragmentB=python_script_6.nodetypes)

# ----
# DISPLAY FORCE POLYGONS
python_script_12 = PythonScript(Assembly=dispatch_2.ListA, startyoffset=Slider(-17, range=-20..-5))  # -> out, gridofpts, polygons, colors, ReactionForceLines, AppliedForceLines, TempForceLines, MemberForceLines, CompressionMembers, TensionMembers
# ---------- python_script_12: Python ----------
import rhinoscriptsyntax as rs
import ghpythonlib.components as gh
import Rhino.Geometry as rg
import System.Drawing as sd
import math
import random

import Assembly as assembly
import Grammar as gr
import Rhino as rc
import Rules as rules
import GraphicStatics as gs

reload (assembly)
reload (gs)
reload (rules)
reload (gr)


#boundary points
nodecount = len(Assembly.Nodes)
boundary = Assembly.Boundary
boundarypts = gh.DeconstructBrep(boundary)[2]


################################################################################
x = []
y = []
for pt in boundarypts:
    x.append(pt.X)
    y.append(pt.Y)

x = gh.SortList(x)[0]
y = gh.SortList(y)[0]

xrange = x[-1]-x[0]
xmid = xrange/2
startx = x[0]
starty = startyoffset

xcount = 5
xspacing = xrange/xcount
ycount = int(math.ceil(nodecount/xcount))
yspacing = -10

################################################################################
gridofpts = []

firstrowpts = []
for i in range(0,xcount+1):
    pt = rg.Point3d(xspacing*i, starty, 0)
    firstrowpts.append(pt)
gridofpts.append(firstrowpts)

if ycount > 1:
    for i in range(0,ycount-1):
        translation = gh.Vector2Pt(rg.Point3d(0,0,0), rg.Point3d(0,yspacing,0), False)[0]
        nextrow = gh.Move(gridofpts[-1], translation)[0]
        gridofpts.append(nextrow)
else:
    pass
gridofpts  = [val for sublist in gridofpts for val in sublist]


del gridofpts[nodecount:]



################################################################################
#Force Polygon
polygons = []
for i in range(0,len(Assembly.Nodes)):
    d = gs.DrawNodeForcePolygon(Assembly.Nodes[i], rg.Point3d(gridofpts[i]))
    polygons.append(d)


ReactionForceLines = []
for forcelist in polygons: # for every node
    for force in forcelist: #for every force at node
        if force.Type == 1: #if the force is a temporary force
            ReactionForceLines.append(force.Line)

AppliedForceLines = []
for forcelist in polygons: # for every node
    for force in forcelist: #for every force at node
        if force.Type == 2: #if the force is a temporary force
            AppliedForceLines.append(force.Line)

TempForceLines = []
for forcelist in polygons: # for every node
    for force in forcelist: #for every force at node
        if force.Type == 3: #if the force is a temporary force
            TempForceLines.append(force.Line)

MemberForceLines = []
for forcelist in polygons: # for every node
    for force in forcelist: #for every force at node
        if force.Type == 4: #if the force is a temporary force
            MemberForceLines.append(force.Line)

CompressionMembers =[]
TensionMembers = []
for forcelist in polygons: # for every node
    for force in forcelist: #for every force at node
        if force.Type == 4: #if the force is a temporary force
            if force.Direction == -1:
                CompressionMembers.append(force.Line)
            else:
                TensionMembers.append(force.Line)



################################################################################



colors = ["219, 107,4", "225, 212,0", "140, 198, 63", "58, 178, 221", "0, 105, 151", "216, 75, 141", "146, 10, 120"]
"""
Orange = "219, 107,4"
Yellow = "225, 212,0"
Green = "140, 198, 63"
Sky = "58, 178, 221"
Blue = "0, 105, 151"
Magenta = "216, 75, 141"
Purple = "146, 10, 120"
"""
# ---------- end python_script_12 ----------
python_script_13 = PythonScript(x=python_script_12.polygons)  # -> a, list; inputs x: list
# ---------- python_script_13: Python ----------
import collections
from Grasshopper import DataTree
from Grasshopper.Kernel.Data import GH_Path


def unpackList(nestedlist):
    dataTree = DataTree[object]()
    for i, item_list in enumerate(nestedlist):
        path = GH_Path(i)
        dataTree.AddRange(item_list, path)
    return dataTree

a = unpackList(x) 













"""
def unpackList(lst):
    tree = DataTree[object]()
    
    for elem in lst:
        path=GH_Path(0)
        if isinstance(elem, collections.Iterable):
            tree.MergeTree(unpackList(elem,path.AppendElement(0)))
        else:
            print(path)
            #tree.Add(elem)
            #tree.Add(elem,path)
            tree.Add(elem,path)
        path = path.Increment(-1)
    return tree

a = unpackList(x) 


list = []
for i in range(0,len(x)):
    a = unpackList(x[i]) 
    list.append(a)
"""
# ---------- end python_script_13 ----------

# ---- group: Compression
force_display = ForceDisplay_2(
    line=graft(python_script_12.CompressionMembers),
    force_type="1",
    tension_compresion="-1",
    col=ColourSwatch(SwatchColor=RGB(33, 33, 33)))

# ---- group: Tension
force_display_2 = ForceDisplay_2(
    line=graft(python_script_12.TensionMembers),
    force_type="1",
    tension_compresion="1",
    col=ColourSwatch(SwatchColor=RGB(143, 143, 143)))

# ----
force_display_3 = ForceDisplay_2(
    line=graft(python_script_12.AppliedForceLines),
    force_type="1",
    tension_compresion="-1",
    col=ColourSwatch(SwatchColor=RGB(0, 113, 189)))

# ---- group: Display Reaction Forces
cluster_2 = Cluster_2()

# ----
force_display_4 = ForceDisplay_2(
    line=graft(python_script_12.ReactionForceLines),
    force_type="1",
    tension_compresion="-1",
    col=ColourSwatch(SwatchColor=RGB(252, 223, 33)))

force_display_5 = ForceDisplay_2(
    line=graft(python_script_12.TempForceLines),
    force_type="1",
    tension_compresion="-1",
    col=ColourSwatch(SwatchColor=RGB(200, 6, 38)))

# ----
# LABEL FORCE POLYGON NODES
number_slider_6 = Slider(-5, range=-5..0)
X_4 = UnitX(Factor=number_slider_6)
Y_4 = UnitY(Factor=number_slider_6)
move_7 = Move(Geometry=python_script_12.gridofpts, Motion=X_4)  # -> Geometry, Transform
move_8 = Move(Geometry=python_script_12.gridofpts, Motion=Y_4)  # -> Geometry, Transform
index_2 = ItemIndex(List=move_8.Geometry, Item=move_8.Geometry)
tag_3 = TextTag3D(
    Location=move_8.Geometry,
    Text=index_2,
    Size=Slider(1, range=1..5),
    Colour=ColourSwatch(SwatchColor=RGB(191, 191, 191)),
    Justification=7)

preview = CustomPreview(Geometry=createhatch.HatchGeometry, Shader=swatch)
previewlw = CustomPreviewLineweights(Geometry=cir, Shader=swatch, Thickness=Slider(6, range=0..20), Absolute=False)
tag_4 = TextTag3D(
    Location=move_2.Geometry,
    Text=index,
    Size=Slider(1, range=1..5),
    Colour=ColourSwatch(SwatchColor=RGB(191, 191, 191)),
    Justification=7)
tag_5 = TextTag3D(
    Location=move_6.Geometry,
    Text=concat_2,
    Size=Slider(0.35, range=0.1..2),
    Colour=ColourSwatch(SwatchColor=RGB(0, 137, 158)),
    Justification=7)
tag_6 = TextTag3D(
    Location=move_4.Geometry,
    Text=concat,
    Size=Slider(0.35, range=0.1..2),
    Colour=ColourSwatch(SwatchColor=RGB(137, 64, 148)),
    Justification=7)

# ----
# DISPLAY MEMBERS
python_script_14 = PythonScript(Assembly=data_12)  # -> nodes, members, memberforceamplitude, memberforcetype, thickness
# ---------- python_script_14: Python ----------
import rhinoscriptsyntax as rs
import ghpythonlib.components as gh
import Rhino.Geometry as rg
import System.Drawing as sd
import math
import random

import Assembly as assembly
import Grammar as gr
import Rhino as rc
import Rules as r
import GraphicStatics as gs

reload (assembly)
reload (gs)
reload (r)



members=[]


memberforceamplitude = []
memberforcetype = []


for member in Assembly.Members:
    members.append(member)
    memberforceamplitude.append(gs.GetMemberForce(member, Assembly)[0])
    memberforcetype.append(gs.GetMemberForce(member, Assembly)[1])

thickness = []
for type in memberforcetype:
    if type == -1:
        thickness.append(5)
    else:
        thickness.append(1)
# ---------- end python_script_14 ----------
dispatch_7 = Dispatch(List=python_script_14.members, DispatchPattern=Toggle(True))  # -> ListA, ListB
swatch_2 = ColourSwatch(SwatchColor=RGB(0, 0, 0))

# ---- group: Force Amplitude
num = Number(simplify(python_script_14.memberforceamplitude))

# ---- group: Force Type
int = Integer(python_script_14.memberforcetype)

# ----
line = Line(simplify(python_script_14.members))
dispatch_8 = Dispatch(List=line, DispatchPattern=toggle)  # -> ListA, ListB
line_2 = Line(simplify(dispatch_8.ListA))
division = Division(A=num, B=Slider(20, range=1..20))
multiplication = Multiplication(A=division, B=-1)
offset = Offset(Curve=line_2, Distance=division, Plane=PlaneXY(0, 0, 0), Corners=1)
offset_2 = Offset(Curve=line_2, Distance=multiplication, Plane=PlaneXY(0, 0, 0), Corners=1)
loft = Loft(
    Curves=[offset, offset_2],
    Options={Adjust=False, Closed=False, LoftEnds=0, LoftSimp=0, LoftType=0, Rebuild=10, Refit=0.01})  # -> simplify(Loft)
multiplication_2 = Multiplication(A=num, B=int)  # -> flatten(Result)
edges = BrepEdges(Brep=loft)  # -> simplify(Naked), Interior, NonManifold
panel_4 = Panel(multiplication_2)
join = JoinCurves(Curves=edges.Naked, Preserve=False)
larger = LargerThan(FirstNumber=panel_4, SecondNumber="0")  # -> LargerThan, OrEqualTo
dispatch_9 = Dispatch(List=flatten(loft), DispatchPattern=larger.LargerThan)  # -> ListA, ListB
dispatch_10 = Dispatch(List=flatten(loft), DispatchPattern=larger.LargerThan)  # -> ListA, ListB
dispatch_11 = Dispatch(List=panel_4, DispatchPattern=larger.LargerThan)  # -> ListA, ListB
preview_2 = CustomPreview(Geometry=[dispatch_9.ListA, dispatch_10.ListA], Shader=ColourSwatch(SwatchColor=RGBA(255, 0, 0, 75)))
preview_3 = CustomPreview(Geometry=[dispatch_9.ListB, dispatch_10.ListB], Shader=ColourSwatch(SwatchColor=RGBA(0, 0, 255, 50)))

crv_3 = Curve(python_script_14.members)
len = Length(Curve=crv_3)
ma = MassAddition(Input=len)  # -> Result, PartialResults
panel_5 = Panel(ma.Result)

# ---- group: Force Amplitude
num_2 = Number(simplify(python_script_14.memberforceamplitude))

# ---- group: Force Type
int_2 = Integer(python_script_14.memberforcetype)

# ----
line_3 = Line(simplify(python_script_14.members))
dispatch_12 = Dispatch(List=line_3, DispatchPattern=toggle)  # -> ListA, ListB
line_4 = Line(simplify(dispatch_12.ListA))
division_2 = Division(A=num_2, B=Slider(20, range=1..20))
multiplication_3 = Multiplication(A=division_2, B=-1)
offset_3 = Offset(Curve=line_4, Distance=division_2, Plane=PlaneXY(0, 0, 0), Corners=1)
offset_4 = Offset(Curve=line_4, Distance=multiplication_3, Plane=PlaneXY(0, 0, 0), Corners=1)
loft_2 = Loft(
    Curves=[offset_3, offset_4],
    Options={Adjust=False, Closed=False, LoftEnds=0, LoftSimp=0, LoftType=0, Rebuild=10, Refit=0.01})  # -> simplify(Loft)
multiplication_4 = Multiplication(A=num_2, B=int_2)  # -> flatten(Result)
edges_2 = BrepEdges(Brep=loft_2)  # -> simplify(Naked), Interior, NonManifold
panel_6 = Panel(multiplication_4)
join_2 = JoinCurves(Curves=edges_2.Naked, Preserve=False)
larger_2 = LargerThan(FirstNumber=panel_6, SecondNumber="0")  # -> LargerThan, OrEqualTo
dispatch_13 = Dispatch(List=panel_6, DispatchPattern=larger_2.LargerThan)  # -> ListA, ListB
dispatch_14 = Dispatch(List=flatten(loft_2), DispatchPattern=larger_2.LargerThan)  # -> ListA, ListB
dispatch_15 = Dispatch(List=flatten(loft_2), DispatchPattern=larger_2.LargerThan)  # -> ListA, ListB
swatch_3 = ColourSwatch(SwatchColor=RGBA(0, 0, 255, 50))
preview_4 = CustomPreview(
    Geometry=[dispatch_14.ListA, dispatch_15.ListA, dispatch_14.ListB, dispatch_15.ListB],
    Shader=ColourSwatch(SwatchColor=RGB(0, 0, 0)))

# ----
# DISPLAY MEMBER INDEX
offset_5 = Offset(Curve=python_script_14.members, Distance=0.4, Plane=PlaneXY(0, 0, 0), Corners=1)
divide = DivideCurve(Curve=offset_5, Count=2, Kinks=False)  # -> Points, Tangents, Parameters
item_2 = ListItem(List=divide.Points, Index=1, Wrap=True)  # -> simplify(flatten(Item))
swatch_4 = ColourSwatch(SwatchColor=RGB(0, 0, 0))
index_3 = ItemIndex(List=dispatch_7.ListA, Item=dispatch_7.ListA)
tag_7 = TextTag3D(Location=item_2, Text=index_3, Size=0.4, Colour=swatch_4, Justification=5)

# ---- group: Node Hatch
number_slider_7 = Slider(0.15, range=0..1)
end = EndPoints(Curve=python_script_14.members)  # -> Start, End
cir_2 = Circle(Plane=end.Start, Radius=number_slider_7)
cir_3 = Circle(Plane=end.End, Radius=number_slider_7)

# ----
createhatch_2 = CreateHatch(Bake=False, Curves=[cir_2, cir_3], HatchPatternName="Solid", HatchScale=1, HatchRotation=0)  # -> HatchGeometry, HatchObjects

preview_5 = CustomPreview(Geometry=createhatch_2.HatchGeometry, Shader=ColourSwatch(SwatchColor=RGB(0, 0, 0)))
previewlw_2 = CustomPreviewLineweights(Geometry=[cir_2, cir_3], Shader=swatch_2, Thickness=1, Absolute=False)
previewlw_3 = CustomPreviewLineweights(Geometry=dispatch_7.ListA, Shader=swatch_2, Thickness=python_script_14.thickness, Absolute=False)

bnd = Bounds(Numbers=dispatch_13.ListB)
dedomain = DeconstructDomain(Domain=bnd)  # -> Start, End

# ----
# FL
len_2 = Length(Curve=python_script_14.members)
multiplication_5 = Multiplication(A=flatten(len_2), B=flatten(python_script_14.memberforceamplitude))
pt_10 = Point(<point referenced from the Rhino model>)

clean = CleanTree(RemoveNulls=True, RemoveInvalid=True, RemoveEmpty=True, Tree=multiplication_5)

ma_2 = MassAddition(Input=clean)  # -> Result, PartialResults
eval = Evaluate(F="Round(number, decimals)", number=ma_2.Result, decimals=Slider(2, range=0..10))
concat_3 = Concatenate(FragmentA="ΣFL = ", FragmentB=eval)
panel_7 = Panel(eval)
python_script_15 = PythonScript(x=eval, currentshape=data_12)  # -> out, a
# ---------- python_script_15: Python ----------
currentshape.Score = x
# ---------- end python_script_15 ----------

tag_8 = TextTag3D(Location=pt_10, Text=concat_3, Size=1.5, Colour=swatch_4, Justification=4)

# ==== cluster MakeNode
tail = ClusterInput()
head = ClusterInput()
type = ClusterInput()
# SUPPORTS INPUT
tail_2 = Point(tail)
head_2 = Point(head)
support_points_input = PythonScript(Tail=tail_2, Head=head_2, Type=type)  # -> AppliedForce, Color, Node; inputs Tail: Point3d, Head: Point3d
# ---------- support_points_input: Python ----------
import rhinoscriptsyntax as rs
import ghpythonlib.components as gh
import Rhino.Geometry as rg
import Rhino as rc
import System.Drawing as sd

import Assembly as assembly
import Grammar as gr
import Rules as r
import GraphicStatics as gs

reload (assembly)
reload (gs)

################################################################################

AppliedForce = gh.Line(Tail, Head) #GH Line Object

################################################################################
# IDENTIFY & ASSIGN

"""
Pass = 0
Support = 1
Load = 2
Float = 3
End = 4
Corner = 5
Tri = 6
Quad = 7
"""

if Type == "1": #Support Point
    ThisNodeType = assembly.NodeType.Support
    ThisForceType = assembly.ForceType.Reaction
    Color = "252, 223,33" #yellow, for support reactions

if Type == "2": #Load Point
    ThisNodeType = assembly.NodeType.Load
    ThisForceType = assembly.ForceType.Applied
    Color = "0, 113, 189" #blue, for applied loads

################################################################################
# CONSTRUCT ASSEMBLY.FORCE

ForceList=[]
Force = assembly.Force(AppliedForce, ThisForceType, -1)
ForceList.append(Force)


Node = assembly.Node(Head, ThisNodeType, ForceList)

Node = gs.RearrangeForces(Node)
Node = gs.EquilibrateNode(Node)
print Node.Forces
################################################################################

"""
print Node.Coordinate
print ThisNodeType
print "Force Head = ", Head
print "Force Tail = ", Tail
print Color 
"""
# ---------- end support_points_input ----------
colour_swatch = ColourSwatch(SwatchColor=RGB(252, 223, 33))

force_display = ForceDisplay(
    line=graft(support_points_input.AppliedForce),
    force_type="1",
    tension_compresion="-1",
    colour=support_points_input.Color)

vector_display_ex = VectorDisplayEx(Point=tail_2, Vector=support_points_input.AppliedForce, Colour=support_points_input.Color, Width="2")  # disabled
node = ClusterOutput(support_points_input.Node)

# ==== cluster MakeAssembly
loads = ClusterInput()
supports = ClusterInput()
boundary = ClusterInput()
loads_2 = Data(loads)
supports_2 = Data(supports)
boundary_2 = Data(boundary)
python_script = PythonScript(Loads=loads_2, Supports=supports_2, Boundary=boundary_2)  # -> StartShape; inputs Loads: list, Supports: list, Boundary: Curve
# ---------- python_script: Python ----------
import rhinoscriptsyntax as rs
import ghpythonlib.components as ghcomp
import Rhino.Geometry as rg
import Rhino as rc
import Rules as r
import System.Drawing as sd


################################################################################
#  IMPORT JUNEY FILES

import Assembly as assembly
import Grammar as gr


################################################################################
#  COMPILE NODES

NodeList = []
NodeList.extend(Loads)
NodeList.extend(Supports)


################################################################################
#  CREATE ASSEMBLY INSTANCE

StartShape = assembly.Assembly(NodeList, [], Boundary)

print StartShape.MyState
print len(StartShape.Nodes)
# ---------- end python_script ----------
startshape = ClusterOutput(python_script)

# ==== cluster PINSUPPORT
support_location = ClusterInput()
color = ClusterInput()
lineweight_scale = ClusterInput()
visual_scale = ClusterInput()
color_2 = Colour(color)

# ---- group: LINEWEIGHT
multiplication = Multiplication(A=1, LineweightScale=lineweight_scale)

# ---- group: VISUAL SCALE
multiplication_2 = Multiplication(A=1, VisualScale=visual_scale)

# ---- group: SUPPORT LOCATION
support_location_2 = Point(support_location)

# ----
pdecon = Deconstruct(Point=support_location_2)  # -> XComponent, YComponent, ZComponent
pt = ConstructPoint(XCoordinate=expr("X+0.6", pdecon.XComponent), YCoordinate=expr("X-1", pdecon.YComponent), ZCoordinate=0)
pt_2 = ConstructPoint(XCoordinate=expr("X-0.6", pdecon.XComponent), YCoordinate=expr("X-1", pdecon.YComponent), ZCoordinate=0)
pt_3 = ConstructPoint(XCoordinate=expr("X+1", pdecon.XComponent), YCoordinate=expr("X-1", pdecon.YComponent), ZCoordinate=0)
pt_4 = ConstructPoint(XCoordinate=expr("X-1", pdecon.XComponent), YCoordinate=expr("X-1", pdecon.YComponent), ZCoordinate=0)
pt_5 = ConstructPoint(XCoordinate=expr("X+1", pdecon.XComponent), YCoordinate=expr("X-1.5", pdecon.YComponent), ZCoordinate=0)
pt_6 = ConstructPoint(XCoordinate=expr("X-1", pdecon.XComponent), YCoordinate=expr("X-1.5", pdecon.YComponent), ZCoordinate=0)
pline = PolyLine(Vertices=[pt_3, pt_4, pt_6, pt_5], Closed=True)
ln = Line(StartPoint=pt_3, EndPoint=pt_4)

# ---- group: Triangle
pline_2 = PolyLine(Vertices=[support_location_2, pt_2, pt], Closed=True)

# ----
createhatch = CreateHatch(Bake=False, Curves=pline, HatchPatternName="Solid", HatchScale=1, HatchRotation=expr("45*pi/180", 0))  # -> HatchGeometry, HatchObjects

scale = Scale(Geometry=pline_2, Center=support_location_2, Factor=multiplication_2)  # -> Geometry, Transform
scale_2 = Scale(Geometry=createhatch.HatchGeometry, Center=support_location_2, Factor=multiplication_2)  # -> Geometry, Transform
multiplication_3 = Multiplication(A=2, B=multiplication)
multiplication_4 = Multiplication(A=1, B=multiplication)

scale_3 = Scale(Geometry=ln, Center=support_location_2, Factor=multiplication_2)  # -> Geometry, Transform
multiplication_5 = Multiplication(A=4, B=multiplication)
entwine = Entwine(Branch00=scale.Geometry, Branch01=scale_3.Geometry, Branch02=scale_2.Geometry, FlattenInputs=True)
entwine_2 = Entwine(Branch00=color_2, Branch01=color_2, Branch02=color_2, FlattenInputs=True)
entwine_3 = Entwine(Branch00=multiplication_3, Branch01=multiplication_5, Branch02=multiplication_4, FlattenInputs=True)
flip = FlipMatrix(Data=entwine)
flip_2 = FlipMatrix(Data=entwine_2)
flip_3 = FlipMatrix(Data=entwine_3)
rotation = ClusterInput()
xy = XYPlane(Origin=support_location_2)
rotation_2 = Data(rotation)
rotate = Rotate(Geometry=xy, Angle=degrees(rotation_2), Plane=xy)  # -> Geometry, Transform
orient = Orient(Geometry=flip, Source=xy, Target=rotate.Geometry)  # -> Geometry, Transform
previewlw = CustomPreviewLineweights(Geometry=orient.Geometry, Shader=flip_2, Thickness=flip_3, Absolute=False)

# ==== cluster Cluster
line = ClusterInput()
line_2 = Line(line)
end = EndPoints(Curve=line_2)  # -> Start, End
vec = Vector(line_2)
vdisex = VectorDisplayEx(Point=end.Start, Vector=vec, Colour=ColourSwatch(SwatchColor=RGB(100, 0, 38)), Width=1)

# ==== cluster Cluster_2
line = ClusterInput()
line_2 = Line(line)
vec = Vector(line_2)
end = EndPoints(Curve=line_2)  # -> Start, End
swatch = ColourSwatch(SwatchColor=RGB(225, 212, 38))
force_display = ForceDisplay_2(line=graft(line_2), force_type="1", tension_compresion="1", col=swatch)
vdisex = VectorDisplayEx(Point=end.Start, Vector=vec, Colour=swatch, Width=2)  # disabled

# ==== cluster ForceDisplay
force_type = ClusterInput()
tension_compresion = ClusterInput()
line = ClusterInput()
colour = ClusterInput()
force_type_2 = Number(force_type)
tension_compresion_2 = Number(tension_compresion)
line_2 = Line(line)
end_points = EndPoints(Curve=line_2)  # -> Start, End
equality = Equality(FirstNumber=tension_compresion_2, SecondNumber=1)  # -> Equality, Inequality
equality_2 = Equality(FirstNumber=tension_compresion_2, SecondNumber=-1)  # -> Equality, Inequality
vector_2pt = Vector2Pt(PointA=end_points.End, PointB=end_points.Start, Unitize=False)  # -> Vector, Length
dispatch = Dispatch(List="1", DispatchPattern=equality.Equality)  # -> ListA, ListB
dispatch_2 = Dispatch(List="2", DispatchPattern=equality_2.Equality)  # -> ListA, ListB
colour_2 = Colour(colour)
radians = Radians(Degrees="15")
rotate = Rotate(Geometry=vector_2pt.Vector, Angle=radians, Plane=PlaneXY(0, 0, 0))  # -> Geometry, Transform
rotate_2 = Rotate(Geometry=vector_2pt.Vector, Angle=expr("x*-1", radians), Plane=PlaneXY(0, 0, 0))  # -> Geometry, Transform

amplitude = Amplitude(Vector=vector_2pt.Vector, Amplitude="1")
move = Move(Geometry=end_points.End, Motion=amplitude)  # -> Geometry, Transform

line_3 = Line(StartPoint=end_points.Start, EndPoint=move.Geometry)
custom_preview_lineweights = CustomPreviewLineweights(Geometry=line_3, Shader=colour_2, Thickness=[dispatch.ListA, dispatch_2.ListA])
amplitude_2 = Amplitude(Vector=rotate.Geometry, Amplitude="1.5")
amplitude_3 = Amplitude(Vector=rotate_2.Geometry, Amplitude="1.5")
move_2 = Move(Geometry=end_points.End, Motion=amplitude_3)  # -> Geometry, Transform
move_3 = Move(Geometry=end_points.End, Motion=amplitude_2)  # -> Geometry, Transform
point = Point(end_points.End)
polyline = PolyLine(Vertices=[point, move_2.Geometry, move.Geometry, move_3.Geometry], Closed=True)
createhatch = CreateHatch(Bake=False, Curves=polyline, HatchPatternName="Hatch1", HatchScale=0.01, HatchRotation=0)
custom_preview_lineweights_2 = CustomPreviewLineweights(Geometry=polyline, Shader=colour_2, Thickness=1)
custom_preview = CustomPreview(Geometry=createhatch, Shader=colour_2)

# ==== cluster ForceDisplay_2
force_type = ClusterInput()
tension_compresion = ClusterInput()
line = ClusterInput()
col = ClusterInput()
force_type_2 = Number(force_type)
tension_compresion_2 = Number(tension_compresion)
line_2 = Line(line)
rad = Radians(Degrees="13")
end = EndPoints(Curve=line_2)  # -> Start, End
equals = Equality(FirstNumber=tension_compresion_2, SecondNumber=1)  # -> Equality, Inequality
equals_2 = Equality(FirstNumber=tension_compresion_2, SecondNumber=-1)  # -> Equality, Inequality
col_2 = Colour(col)
vec2pt = Vector2Pt(PointA=end.End, PointB=end.Start, Unitize=False)  # -> Vector, Length
dispatch = Dispatch(List="1", DispatchPattern=equals.Equality)  # -> ListA, ListB
dispatch_2 = Dispatch(List="2", DispatchPattern=equals_2.Equality)  # -> ListA, ListB

amp = Amplitude(Vector=vec2pt.Vector, Amplitude="0.8")
move = Move(Geometry=end.End, Motion=amp)  # -> Geometry, Transform

rotate = Rotate(Geometry=vec2pt.Vector, Angle=expr("x*-1", rad), Plane=PlaneXY(0, 0, 0))  # -> Geometry, Transform
ln = Line(StartPoint=end.Start, EndPoint=move.Geometry)
previewlw = CustomPreviewLineweights(Geometry=ln, Shader=col_2, Thickness=[dispatch.ListA, dispatch_2.ListA], Absolute=False)
amp_2 = Amplitude(Vector=rotate.Geometry, Amplitude="1")
rotate_2 = Rotate(Geometry=vec2pt.Vector, Angle=rad, Plane=PlaneXY(0, 0, 0))  # -> Geometry, Transform
amp_3 = Amplitude(Vector=rotate_2.Geometry, Amplitude="1")
move_2 = Move(Geometry=end.End, Motion=amp_2)  # -> Geometry, Transform
pt = Point(end.End)
move_3 = Move(Geometry=end.End, Motion=amp_3)  # -> Geometry, Transform
pline = PolyLine(Vertices=[pt, move_2.Geometry, move.Geometry, move_3.Geometry], Closed=True)
createhatch = CreateHatch(Bake=False, Curves=pline, HatchPatternName="Solid", HatchScale=1, HatchRotation=0)  # -> HatchGeometry, HatchObjects
preview = CustomPreview(Geometry=createhatch.HatchGeometry, Shader=col_2)
previewlw_2 = CustomPreviewLineweights(Geometry=pline, Shader=col_2, Absolute=False)
